vi "About.gvi"   [LabVIEW NXG 5.1.0]
inputs:
  "error in (no error)": error
outputs:
  "error out": error
panel controls:
  "OK": bool
uses:
  Component::UI Controls::IApplicationMgr::IApplicationMgr.GetEngine.gvi
  Component::Engine::IEngine::IEngine.GetLicenseDescription.gvi
  TSUtility::TestStand - Get Resource String.gvi
  TestExec::Dependencies::About.gvi
diagram:
  # This VI is the About Box for the user interface.
  # All of the text it displays is localized.
  case ($"error in (no error)") {
    frame No Error {
      w2 = "TestExec::Global Controls::Control Globals.grsc::Application Manager"
      Tag Read(ref in=w2) -> (Data=w3)
      call "IApplicationMgr.GetEngine.gvi"(reference in=w3, error in=$"error in (no error)") -> (error out=w4, return=w5)
      Is First Call() -> w6
      case (w6) {
        frame False, Default {
          w7 = w4
          w8 = w5
        }
        frame True {
          Property Node(instance in=w5, error in=w4) -> ("VersionString"=w9, error out=w10, instance out=w11)
          call "IEngine.GetLicenseDescription.gvi"(reference in=w11, error in=w10) -> (error out=w12, return=w13)
          Property Node(instance in=reference to unnamed text, error in=w12) -> ("Text"=w14, error out=w15, instance out=w16)
          Concatenate Strings(w14, " ", w9) -> w17
          Property Node(instance in=w16, "Text"=w17, error in=w15) -> (error out=w18)
          # Only append version information to the
          # captions the first time this VI is called.
          Property Node(instance in=reference to unnamed text, error in=w18) -> ("Text"=w19, error out=w20, instance out=w21)
          Concatenate Strings(w19, " ", "2020 (20.0.0)") -> w22
          Property Node(instance in=w21, "Text"=w22, error in=w20) -> (error out=w23)
          Property Node(instance in=reference to unnamed text, error in=w23) -> ("Text"=w24, error out=w25, instance out=w26)
          Concatenate Strings(w24, w13) -> w27
          Property Node(instance in=w26, "Text"=w27, error in=w25) -> (error out=w7)
          w8 = w5
        }
      }
      # Always set strings that vary according to editor mode because editor mode can change
      Property Node(instance in=w3, error in=w7) -> ("IsEditor"=w28, error out=w29)
      Select(s=w28, t="TSUI_OI_EDITOR_ABOUT_BOX", f="TSUI_OI_ABOUT_BOX") -> w30
      call "TestStand - Get Resource String.gvi"(Engine Reference In=w8, Category=w30, Symbol="USER_INT_MSG_LVNXG", Error In=w29) -> (Engine Reference Out=w31, Resource String=w32, Error Out=w33)
      Close Reference(error in=w33, reference=w31) -> (error out=w34)
      Property Node(instance in=reference to unnamed text, "Text"=w32, error in=w34) -> (error out=w35)
      case (w35) {
        frame No Error {
          call "About.gvi"() -> (VIReference=w36)
          Property Node(instance in=w36, error in=w35) -> ("Panel"=w37, error out=w38)
          Property Node(instance in=w37, error in=w38) -> ("Window"=w39, error out=w40)
          Open Window(reference in=w39, error in=w40, modal=TRUE) -> (reference out=w41, error out=w42)
          s1 = w42  # shift register
          while {
            Wait(time to wait=50)
            stop if $OK
          }
          Close Window(reference in=w41, error in=s1) -> (error out=w1)
        }
        frame Error {
          w1 = w35
        }
      }
    }
    frame Error {
      w1 = $"error in (no error)"
    }
  }
  $"error out" <- w1
