vi "Add To Menu Queue.gvi"   [LabVIEW NXG 2.0.0]
inputs:
  "Menu Command": string
  "error in": error
outputs:
  "error out": error
types:
  "Menu Queue Item Type.gtype" = cluster{"Command": string}
uses:
  NI::G Core::Error::Clear Error Cluster.gvi
diagram:
  case ($"error in") {
    frame No Error {
      w1 = $"error in"
    }
    frame Error {
      # Ignore errors if
      # shutdown queue
      Is Equal(x=$"Menu Command", y="SHUTDOWN MENU QUEUE") -> w2
      case (w2) {
        frame False, Default {
          w1 = $"error in"
        }
        frame True {
          call "Clear Error Cluster.gvi"(error in=$"error in") -> (error out=w1)
        }
      }
    }
  }
  case (w1) {
    frame No Error {
      Property Node(instance in="Menu Queue Item Type.gtype" {all zero or empty}, "Command"=$"Menu Command") -> (instance out=w4)
      Obtain Queue(create if not found=FALSE, element data type="Menu Queue Item Type.gtype" {all zero or empty}, error in=w1, name="TSUIMenuQueue") -> (error out=w5, queue out=w6)
      Enqueue Element(element=w4, error in=w5, queue=w6) -> (error out=w3)
    }
    frame Error {
      w3 = w1
    }
  }
  $"error out" <- w3
