vi "Add User Menu Items.gvi"   [LabVIEW NXG 3.0.0]
inputs:
  "error in (no error)": error
  "Menu Refnum In": "ApplicationMenu reference"
outputs:
  "menu reference out": "ApplicationMenu reference"
  "error out": error
uses:
  Component::UI Controls::IApplicationMgr::IApplicationMgr.GetEngine.gvi
  TSUtility::TestStand - Get Resource String.gvi
diagram:
  w1 = "TestExec::Global Controls::Control Globals.grsc::Application Manager"
  # Any custom user menus should be added dynamically here.  Do not add menu items statically because the menus are regenerated each time they are activated since they change based on the current selections
  Tag Read(ref in=w1) -> (Data=w2)
  call "IApplicationMgr.GetEngine.gvi"(reference in=w2, error in=$"error in (no error)") -> (error out=w3, return=w4)
  call "TestStand - Get Resource String.gvi"(Engine Reference In=w4, Category="TSUI_OI_MAIN_PANEL", Symbol="TS_ABOUT", Error In=w3, Default String="About") -> (Engine Reference Out=w5, Resource String=w6, Error Out=w7)
  Close Reference(error in=w7, reference=w5) -> (error out=w8)
  Insert Menu Items(error in=w8, item names=w6, item tags="ABOUT", menu tag="HELP", reference in=$"Menu Refnum In") -> (error out=w9, reference out=w10)
  $"menu reference out" <- w10
  $"error out" <- w9
