vi "CurPageChanged Event.gvi"   [LabVIEW NXG 2.0.0]
inputs:
  "Event common data": T1
  "Control ref": COM
  "Event data": cluster{"CurrentPage": i32}
  "User Parameter": "LabVIEW Events.gtype"
types:
  T1 = cluster{"Event Source": i32, "Event Type": u32, "Time Stamp": u32, "Index": u32}
  "LabVIEW Events.gtype" = cluster{"Quit Application Event": "event Quit Application Event", "ReDraw Event": "event ReDraw", "Config Tab Event": "event Switch Tab Event"}
uses:
  TestExec::Dependencies::Get and Set Control Focus.gvi
  TestExec::Dependencies::Update Title Bar Text.gvi
diagram:
  Property Node(instance in=$"Control ref") -> ("hWnd"=w1, "CurrentPage"=w2, error out=w3)
  # The ListBar generates the CurPageChanged event
  # when the user changes the current page in the
  # ListBar. The user interface can then update
  # its other controls appropriately.
  #
  # Note: This VI is marked to be reentrant since it
  # is an ActiveX event callback VI.
  Property Node(instance in=$"User Parameter") -> ("Config Tab Event"=w4)
  # Show the appropriate tabs based
  # on the current ListBar page. Also
  # set the focus to the ListBar control.
  Property Node(instance in=cluster{"Active Tab": i32} {all zero or empty}, "Active Tab"=w2) -> (instance out=w5)
  Generate User Event(error in=w3, event data=w5, user event=w4) -> (error out=w6)
  call "Get and Set Control Focus.gvi"(Operation="Set Focus", hWnd=w1, error in (no error)=w6) -> (error out=w7)
  call "Update Title Bar Text.gvi"(error in (no error)=w7)
