vi "DisplayExecution Event.gvi"   [LabVIEW NXG 2.0.0]
inputs:
  "Event common data": T1
  "Control ref": COM
  "Event data": cluster{"exec": COM, "reason": i32}
  "User Parameter": "LabVIEW Events.gtype"
types:
  T1 = cluster{"Event Source": i32, "Event Type": u32, "Time Stamp": u32, "Index": u32}
  "LabVIEW Events.gtype" = cluster{"Quit Application Event": "event Quit Application Event", "ReDraw Event": "event ReDraw", "Config Tab Event": "event Switch Tab Event"}
diagram:
  # Note: Any programmatic updates to native NXG controls, such as the tab control, should be implemented in the main UI and not in a registered event.  This Callback generates a user event which is handled in the main UI event structure. Programmatic updates to controls within registered activeX events can cause lv NXG to hang.
  Property Node(instance in=$"User Parameter") -> ("Config Tab Event"=w1)
  Property Node(instance in=$"Event data") -> ("exec"=w2)
  w3 = "TestExec\\Global Controls\\Control Globals.grsc\\Execution View Manager"
  Tag Read(ref in=w3) -> (Data=w4)
  Property Node(instance in=w4, "Execution"=w2) -> (error out=w5)
  # The Application Manager generates the DisplayExecution
  # event when TestStand starts a new execution that is not
  # initially hidden. It also generates the event when the
  # execution breaks.
  #
  # Note: This VI is marked to be reentrant since it is an
  # ActiveX event callback VI.
  Tag Read(ref in="TestExec\\Global Controls\\Control Globals.grsc\\ListBar") -> (Data=w6)
  # Change the ListBar to display
  # the Executions page and show
  # the appropriate tabs in the tab
  # control.
  Property Node(instance in=w6, "CurrentPage"=1, error in=w5) -> (error out=w7)
  Property Node(instance in=cluster{"Active Tab": i32} {all zero or empty}, "Active Tab"=1) -> (instance out=w8)
  Generate User Event(error in=w7, event data=w8, user event=w1)
