vi "DisplayReport Event.gvi"   [LabVIEW NXG 2.0.0]
inputs:
  "Event common data": T1
  "Control ref": COM
  "Event data": cluster{"exec": COM}
  "User Parameter": "LabVIEW Events.gtype"
types:
  T1 = cluster{"Event Source": i32, "Event Type": u32, "Time Stamp": u32, "Index": u32}
  "LabVIEW Events.gtype" = cluster{"Quit Application Event": "event Quit Application Event", "ReDraw Event": "event ReDraw", "Config Tab Event": "event Switch Tab Event"}
uses:
  TestExec::Dependencies::Set Tab Control Value for Execution.gvi
diagram:
  # The Application Manager generates the DisplayReport event when there
  # is a new report to display. The user interface can then update its
  # controls appropriately.
  #
  # Note: This VI is marked to be reentrant since it is an ActiveX event
  # callback VI.
  # If the execution that has the new
  # report is the same as the currently
  # displayed execution, then change
  # the current tab appropriately.
  # Otherwise do nothing.
  Property Node(instance in=$"User Parameter") -> ("Config Tab Event"=w1)
  Property Node(instance in=$"Event data") -> ("exec"=w2)
  # Set the tab page for this execution
  # to be the Report tab.
  call "Set Tab Control Value for Execution.gvi"(Execution In=w2, Tab Control Value=2) -> (Execution Out=w3, error out=w4)
  Property Node(instance in=w3, error in=w4) -> ("Id"=w5, error out=w6)
  w7 = "TestExec\\Global Controls\\Control Globals.grsc\\Execution View Manager"
  Tag Read(ref in=w7) -> (Data=w8)
  Property Node(instance in=w8, error in=w6) -> ("Execution"=w9, error out=w10)
  Property Node(instance in=w9, error in=w10) -> ("Id"=w11, error out=w12, instance out=w13)
  Close Reference(error in=w12, reference=w13) -> (error out=w14)
  Is Equal(x=w5, y=w11) -> w15
  case (w15) {
    frame False, Default { }
    frame True {
      Tag Read(ref in="TestExec\\Global Controls\\Control Globals.grsc\\ListBar") -> (Data=w16)
      Property Node(instance in=w16, error in=w14) -> ("CurrentPage"=w17, error out=w18)
      Property Node(instance in=cluster{"Active Tab": i32} {all zero or empty}, "Active Tab"=w17) -> (instance out=w19)
      Generate User Event(error in=w18, event data=w19, user event=w1)
    }
  }
