vi "DisplaySequenceFile Event.gvi"   [LabVIEW NXG 2.0.0]
inputs:
  "Event common data": T1
  "Control ref": COM
  "Event data": cluster{"file": COM, "reason": i32}
  "User Parameter": "LabVIEW Events.gtype"
types:
  T1 = cluster{"Event Source": i32, "Event Type": u32, "Time Stamp": u32, "Index": u32}
  "LabVIEW Events.gtype" = cluster{"Quit Application Event": "event Quit Application Event", "ReDraw Event": "event ReDraw", "Config Tab Event": "event Switch Tab Event"}
diagram:
  # Note: Any programmatic updates to native NXG controls, such as the tab control, should be implemented in the main UI and not in a registered event.  This Callback generates a user event which is handled in the main UI event structure. Programmatic updates to controls within registered activeX events can cause lv NXG to hang.
  Property Node(instance in=$"User Parameter") -> ("Config Tab Event"=w1)
  Tag Read(ref in="TestExec\\Global Controls\\Control Globals.grsc\\ListBar") -> (Data=w2)
  w3 = "TestExec\\Global Controls\\Control Globals.grsc\\Sequence File View Manager"
  Tag Read(ref in=w3) -> (Data=w4)
  Property Node(instance in=$"Event data") -> ("file"=w5)
  Property Node(instance in=w4, "SequenceFile"=w5) -> (error out=w6)
  # Change the ListBar to display the
  # Sequence Files page and show
  # the appropriate tabs in the tab
  # control.
  Property Node(instance in=w2, "CurrentPage"=0, error in=w6) -> (error out=w7)
  # The Application Manager generates the DisplaySequenceFile event
  # when TestStand opens a sequence file. The user interface can
  # then set this sequence file to be the current sequence file held by
  # the SequenceFileView Manager. It can also update its controls
  # appropriately.
  #
  # Note: This VI is marked to be reentrant since it is an ActiveX
  # event callback VI.
  Property Node(instance in=cluster{"Element 1": i32} {all zero or empty}, "Element 1"=0) -> (instance out=w8)
  Generate User Event(error in=w7, event data=w8, user event=w1)
