vi "ExecutionChanged Event.gvi"   [LabVIEW NXG 2.0.0]
inputs:
  "Event common data": T1
  "Control ref": COM
  "Event data": cluster{"exec": COM}
  "User Parameter": "LabVIEW Events.gtype"
types:
  T1 = cluster{"Event Source": i32, "Event Type": u32, "Time Stamp": u32, "Index": u32}
  "LabVIEW Events.gtype" = cluster{"Quit Application Event": "event Quit Application Event", "ReDraw Event": "event ReDraw", "Config Tab Event": "event Switch Tab Event"}
diagram:
  # Show the appropriate tabs for the
  # execution.
  Property Node(instance in=$"User Parameter") -> ("Config Tab Event"=w1)
  Tag Read(ref in="TestExec\\Global Controls\\Control Globals.grsc\\ListBar") -> (Data=w2)
  Property Node(instance in=w2) -> (error out=w3, instance out=w4)
  Property Node(instance in=w4, error in=w3) -> ("CurrentPage"=w5, error out=w6)
  # The ExecutionView Manager generates the ExecutionChanged event when a different
  # execution is being viewed. The user interface can then update its controls
  # appropriately.
  #
  # Note: This VI is marked to be reentrant since it is an ActiveX event callback VI.
  Property Node(instance in=cluster{"Active Tab": i32} {all zero or empty}, "Active Tab"=w5) -> (instance out=w7)
  Generate User Event(error in=w6, event data=w7, user event=w1)
