vi "ExitApplication Event.gvi"   [LabVIEW NXG 2.0.0]
inputs:
  "Control ref": COM
  "User Parameter": "LabVIEW Events.gtype"
  "Event common data": T1
types:
  T1 = cluster{"Event Source": i32, "Event Type": u32, "Time Stamp": u32, "Index": u32}
  "LabVIEW Events.gtype" = cluster{"Quit Application Event": "event Quit Application Event", "ReDraw Event": "event ReDraw", "Config Tab Event": "event Switch Tab Event"}
diagram:
  # The Application Manager generates the ExitApplication event when TestStand is finished shutting down.
  # This event signals that the user interface can stop. Additionally, the user interface can release
  # any references it has to TestStand objects, including menu commands.
  #
  #
  # Note: This VI is marked to be reentrant since it is an ActiveX event callback VI.
  # Fire Quit Application Event so that the Main
  # Event Loop in Top-Level VI.vi can stop.
  Property Node(instance in=$"User Parameter") -> ("Quit Application Event"=w1)
  Generate User Event(event data=cluster{"Element 1": i32} {all zero or empty}, user event=w1)
