vi "Insertion Palette KeyDown Event.gvi"   [LabVIEW NXG 2.0.0]
inputs:
  "Event common data": T1
  "Control ref": COM
  "Event data In": cluster{"keyCode": i16, "shift": i16}
  "User parameter": variant
outputs:
  "Event data out": cluster{"keyCode": i16}
types:
  T1 = cluster{"Event Source": i32, "Event Type": u32, "Time Stamp": u32, "Index": u32}
uses:
  TestExec::Dependencies::Process Delete Keydown.gvi
diagram:
  Property Node(instance in=$"Event data In") -> ("keyCode"=w1, "shift"=w2)
  call "Process Delete Keydown.gvi"(keyCode=w1, shift=w2) -> (KeyCode out=w3)
  Property Node(instance in=cluster{"KeyCode out": i16} {all zero or empty}, "KeyCode out"=w3) -> (instance out=w4)
  $"Event data out" <- w4
