vi "ListBar CreateContextMenu Event.gvi"   [LabVIEW NXG 2.0.0]
inputs:
  "Event common data": T1
  "Control ref": COM
  "Event data": cluster{"menuHandle": i32, "x": i32, "y": i32}
  "User Parameter": "LabVIEW Events.gtype"
types:
  T1 = cluster{"Event Source": i32, "Event Type": u32, "Time Stamp": u32, "Index": u32}
  "LabVIEW Events.gtype" = cluster{"Quit Application Event": "event Quit Application Event", "ReDraw Event": "event ReDraw", "Config Tab Event": "event Switch Tab Event"}
uses:
  Component::UI Controls::IApplicationMgr::IApplicationMgr.NewCommands.gvi
  Component::UI Controls::Commands::Commands.InsertKind.gvi
  Component::UI Controls::Commands::Commands.InsertIntoWin32Menu.gvi
diagram:
  Property Node(instance in=$"Control ref") -> ("CurrentPage"=w1, error out=w2)
  w3 = "TestExec\\Global Controls\\Control Globals.grsc\\Application Manager"
  Tag Read(ref in=w3) -> (Data=w4)
  call "IApplicationMgr.NewCommands.gvi"(reference in=w4, error in=w2) -> (error out=w5, return=w6)
  # The ListBar control generates the CreateContextMenu event when
  # the user right clicks on the control. The user interface can then create
  # a context menu to display.
  #
  # Note: This VI is marked to be reentrant since it is an ActiveX event callback VI.
  w7 = "TestExec\\Global Controls\\Control Globals.grsc\\Sequence File View Manager"
  Tag Read(ref in=w7) -> (Data=w8)
  w9 = "TestExec\\Global Controls\\Control Globals.grsc\\Execution View Manager"
  Tag Read(ref in=w9) -> (Data=w10)
  case (w1) {
    frame 0, Default {
      # Sequence Files page...
      call "Commands.InsertKind.gvi"(reference in=w6, error in=w5, cmdKind in="CommandKind_DefaultListBarContextMenu_Set"(127), managerControl=w8, insertBefore=-1, currentMenuName="", allMenuNames="") -> (reference out=w12, error out=w11)
    }
    frame 1 {
      # Executions page...
      call "Commands.InsertKind.gvi"(reference in=w6, error in=w5, cmdKind in="CommandKind_DefaultListBarContextMenu_Set"(127), managerControl=w10, insertBefore=-1, currentMenuName="", allMenuNames="") -> (reference out=w12, error out=w11)
    }
  }
  Property Node(instance in=$"Event data") -> ("menuHandle"=w13)
  call "Commands.InsertIntoWin32Menu.gvi"(useShortcutKeys=TRUE, reference in=w12, error in=w11, menuHandle=w13, menuItemToInsertBefore=-1, byPosition=TRUE) -> (reference out=w14, error out=w15)
  Close Reference(error in=w15, reference=w14)
