vi "PostCommandExecute Event.gvi"   [LabVIEW NXG 2.0.0]
inputs:
  "Event common data": T1
  "Control ref": COM
  "Event data": cluster{"Command": COM}
  "User Parameter": "LabVIEW Events.gtype"
types:
  T1 = cluster{"Event Source": i32, "Event Type": u32, "Time Stamp": u32, "Index": u32}
  "LabVIEW Events.gtype" = cluster{"Quit Application Event": "event Quit Application Event", "ReDraw Event": "event ReDraw", "Config Tab Event": "event Switch Tab Event"}
diagram:
  Property Node(instance in=$"User Parameter") -> ("Config Tab Event"=w1)
  Property Node(instance in=$"Event data") -> ("Command"=w2)
  Property Node(instance in=w2) -> ("Kind"=w3)
  Is Equal(x=w3, y="CommandKind_CloseCompletedExecutions"(23)) -> w4
  # Note: Any programmatic updates to native NXG controls, such as the tab control, should be implemented in the main UI and not in a registered event.  This Callback generates a user event which is handled in the main UI event structure. Programmatic updates to controls within registered activeX events can cause lv NXG to hang.
  case (w4) {
    frame False, Default { }
    frame True {
      w5 = "TestExec\\Global Controls\\Control Globals.grsc\\Application Manager"
      Tag Read(ref in=w5) -> (Data=w6)
      Property Node(instance in=w6) -> ("Executions"=w7, error out=w8)
      Property Node(instance in=w7, error in=w8) -> ("Count"=w9, error out=w10, instance out=w11)
      Is Equal To 0(x=w9) -> w12
      # if we closed all the executions, switch to the files page instead of showing an empty executions page
      case (w12) {
        frame False, Default { }
        frame True {
          Generate User Event(error in=w10, event data=cluster{"Active Tab": i32} {all zero or empty}, user event=w1)
        }
      }
      Close Reference(reference=w11)
    }
  }
