vi "Register Report Error.gvi"   [LabVIEW NXG 2.0.0]
inputs:
  "error in (no error)": error
outputs:
  "error out": error
uses:
  TestExec::Dependencies::Callbacks::ReportError Event.gvi
diagram:
  # Register Report Error Callback as the first step of the initialization
  # so that errors can be reported.
  call "ReportError Event.gvi"() -> (VIReference=w1)
  w2 = "TestExec\\Global Controls\\Control Globals.grsc\\Application Manager"
  Tag Read(ref in=w2) -> (Data=w3)
  Register Event Callback(w3, w1, _, error in=$"error in (no error)") -> (error out=w4)
  $"error out" <- w4
