vi "ReportError Event.gvi"   [LabVIEW NXG 2.0.0]
inputs:
  "Event common data": T2
  "Control ref": COM
  "Event data": T1
  "User Parameter": variant
types:
  T1 = cluster{"errorCode": i32, "errorMessage": string}
  T2 = cluster{"Event Source": i32, "Event Type": u32, "Time Stamp": u32, "Index": u32}
uses:
  TSUtility::TestStand - Append Code and Description to Error Source.gvi
  TestExec::Dependencies::Display Error.gvi
diagram:
  # The Application Manager generates the ReportError event
  # when TestStand generates an error.
  #
  # Note: This VI is marked to be reentrant since it is an
  # ActiveX event callback VI.
  Property Node(instance in=$"Event data") -> ("errorCode"=w1, "errorMessage"=w2)
  Property Node(instance in=error {"status"=TRUE, "code"=0, "source"=""}, "code"=w1, "source"=w2) -> (instance out=w3)
  call "TestStand - Append Code and Description to Error Source.gvi"(Application Manager Ref In=$"Control ref", error in (no error)=w3) -> (error out=w4)
  # Display error information.
  call "Display Error.gvi"(Try Getting Error String from Engine (True)=FALSE, error in (no error)=w4)
