vi "Resized Event.gvi"   [LabVIEW NXG 2.0.0]
inputs:
  "Event common data": T1
  "Control ref": COM
  "Event data": cluster{"newWidth": i16, "newHeight": i16}
  "User Parameter": "LabVIEW Events.gtype"
types:
  T1 = cluster{"Event Source": i32, "Event Type": u32, "Time Stamp": u32, "Index": u32}
  "LabVIEW Events.gtype" = cluster{"Quit Application Event": "event Quit Application Event", "ReDraw Event": "event ReDraw", "Config Tab Event": "event Switch Tab Event"}
diagram:
  # The StatusBar generates the Resized event when it
  # resizes or moves on the panel of the VI. The user
  # interface can then move and resize the other controls
  # on the panel appropriately.
  #
  # Note: This VI is marked to be reentrant since it
  # is an ActiveX event callback VI.
  Property Node(instance in=$"User Parameter") -> ("ReDraw Event"=w1)
  Generate User Event(event data=cluster{"Number": i32} {all zero or empty}, user event=w1)
