vi "SequencesList CreateContextMenu Event.gvi"   [LabVIEW NXG 2.0.0]
inputs:
  "Event common data": T1
  "Control ref": COM
  "Event data": cluster{"menuHandle": i32, "x": i32, "y": i32}
  "User Parameter": "LabVIEW Events.gtype"
types:
  T1 = cluster{"Event Source": i32, "Event Type": u32, "Time Stamp": u32, "Index": u32}
  "LabVIEW Events.gtype" = cluster{"Quit Application Event": "event Quit Application Event", "ReDraw Event": "event ReDraw", "Config Tab Event": "event Switch Tab Event"}
uses:
  Component::UI Controls::IApplicationMgr::IApplicationMgr.NewCommands.gvi
  Component::UI Controls::Commands::Commands.InsertKind.gvi
  Component::UI Controls::Commands::Commands.InsertIntoWin32Menu.gvi
diagram:
  Property Node(instance in=$"Event data") -> ("menuHandle"=w1)
  w2 = "TestExec\\Global Controls\\Control Globals.grsc\\Application Manager"
  Tag Read(ref in=w2) -> (Data=w3)
  call "IApplicationMgr.NewCommands.gvi"(reference in=w3) -> (error out=w4, return=w5)
  w6 = "TestExec\\Global Controls\\Control Globals.grsc\\Sequence File View Manager"
  Tag Read(ref in=w6) -> (Data=w7)
  # The ListBar control generates the CreateContextMenu event when
  # the user right clicks on the control. The user interface can then create
  # a context menu to display.
  #
  # Note: This VI is marked to be reentrant since it is an ActiveX event callback VI.
  # Sequence Files page...
  call "Commands.InsertKind.gvi"(reference in=w5, error in=w4, cmdKind in="CommandKind_DefaultSequenceListContextMenu_Set"(129), managerControl=w7, insertBefore=-1, currentMenuName="", allMenuNames="") -> (reference out=w8, error out=w9)
  call "Commands.InsertIntoWin32Menu.gvi"(useShortcutKeys=TRUE, reference in=w8, error in=w9, menuHandle=w1, menuItemToInsertBefore=-1, byPosition=TRUE) -> (reference out=w10, error out=w11)
  Close Reference(error in=w11, reference=w10)
