vi "StartExecution Event.gvi"   [LabVIEW NXG 2.0.0]
inputs:
  "Event common data": T1
  "Control ref": COM
  "Event data": T2
  "User Parameter": "LabVIEW Events.gtype"
types:
  T1 = cluster{"Event Source": i32, "Event Type": u32, "Time Stamp": u32, "Index": u32}
  T2 = cluster{"exec": COM, "thrd": COM, "initiallyHidden": bool}
  "LabVIEW Events.gtype" = cluster{"Quit Application Event": "event Quit Application Event", "ReDraw Event": "event ReDraw", "Config Tab Event": "event Switch Tab Event"}
uses:
  TestExec::Dependencies::Set Tab Control Value for Execution.gvi
diagram:
  # The Application Manager generates the StartExecution event when
  # an execution starts. The user interface can then update its
  # controls appropriately.
  #
  # Note: This VI is marked to be reentrant since it is an ActiveX
  # event callback VI.
  Property Node(instance in=$"Event data") -> ("exec"=w1)
  # Set the tab page for this execution to
  # be the Execution page.
  call "Set Tab Control Value for Execution.gvi"(Execution In=w1, Tab Control Value=1)
