vi "CheckControlReferences.gvi"   [LabVIEW NXG 2.0.0]
# Checks whether the Globals for UI Control References are valid
inputs:
  "error in (no error)": error
outputs:
  "error out": error
uses:
  TSUtility::TestStand API Numeric Constants.gvi
diagram:
  Tag Read(ref in="TestExec\\Global Controls\\Control Globals.grsc\\ListBar") -> (Data=w1)
  Is Not A Number Or Path Or Refnum(number=w1) -> w2
  Tag Read(ref in="TestExec\\Global Controls\\Control Globals.grsc\\CallStack") -> (Data=w3)
  Is Not A Number Or Path Or Refnum(number=w3) -> w4
  Tag Read(ref in="TestExec\\Global Controls\\Control Globals.grsc\\Threads") -> (Data=w5)
  Is Not A Number Or Path Or Refnum(number=w5) -> w6
  w7 = "TestExec\\Global Controls\\Control Globals.grsc\\Execution Variables"
  Tag Read(ref in=w7) -> (Data=w8)
  Is Not A Number Or Path Or Refnum(number=w8) -> w9
  w10 = "TestExec\\Global Controls\\Control Globals.grsc\\File Variables"
  Tag Read(ref in=w10) -> (Data=w11)
  Is Not A Number Or Path Or Refnum(number=w11) -> w12
  Tag Read(ref in="TestExec\\Global Controls\\Control Globals.grsc\\FileSteps") -> (Data=w13)
  Is Not A Number Or Path Or Refnum(number=w13) -> w14
  w15 = "TestExec\\Global Controls\\Control Globals.grsc\\SequencesList"
  Tag Read(ref in=w15) -> (Data=w16)
  Is Not A Number Or Path Or Refnum(number=w16) -> w17
  w18 = "TestExec\\Global Controls\\Control Globals.grsc\\Execution Steps"
  Tag Read(ref in=w18) -> (Data=w19)
  Is Not A Number Or Path Or Refnum(number=w19) -> w20
  w21 = "TestExec\\Global Controls\\Control Globals.grsc\\InsertionPalette"
  Tag Read(ref in=w21) -> (Data=w22)
  Is Not A Number Or Path Or Refnum(number=w22) -> w23
  Logical Or(w2, w4, w6, w9, w12, w14, w17, w20, w23) -> w24
  # Check to see if the control references are valid before doing anything else. Create an appropriate error message if not.
  case (w24) {
    frame False, Default {
      w25 = $"error in (no error)"
    }
    frame True {
      w26 = "Control(s) could not be loaded. This TestStand User Interface may have been built for a version of TestStand different than the version that is currently active. Use the TestStand Version Selector to activate the correct version and ensure that %s TestStand is installed."
      # If the controls aren't registered, that likely means the engine isn't registered either. Thus we cannot reliably localize this error message.
      disable {
        frame TARGET_BITNESS=="64" {
          w27 = "64-bit"
        }
        frame TARGET_BITNESS=="32", Default {
          w27 = "32-bit"
        }
      }
      Format Into String(formatString=w26, w27) -> w28
      call "TestStand API Numeric Constants.gvi"(TestStand API Numeric Constants="TS_Err_UnknownType") -> (Value=w29)
      Property Node(instance in=error {"status"=TRUE, "code"=0, "source"=""}, "code"=w29, "source"=w28) -> (instance out=w25)
    }
  }
  $"error out" <- w25
