vi "Close All Borders.gvi"   [LabVIEW NXG 2.0.0]
inputs:
  "error in (no error)": error
outputs:
  "error out": error
uses:
  TestExec::Dependencies::Close Borders Reference.gvi
diagram:
  # Close all borders
  w1 = "TestExec\\Global Controls\\Control Globals.grsc\\ExecutionVariables Borders"
  Tag Read(ref in=w1) -> (Data=w2)
  w3 = "TestExec\\Global Controls\\Control Globals.grsc\\ExecutionSteps Borders"
  Tag Read(ref in=w3) -> (Data=w4)
  w5 = "TestExec\\Global Controls\\Control Globals.grsc\\FileSteps Borders"
  Tag Read(ref in=w5) -> (Data=w6)
  w7 = "TestExec\\Global Controls\\Control Globals.grsc\\FileVariables Borders"
  Tag Read(ref in=w7) -> (Data=w8)
  w9 = "TestExec\\Global Controls\\Control Globals.grsc\\InsertionPalette Borders"
  Tag Read(ref in=w9) -> (Data=w10)
  w11 = "TestExec\\Global Controls\\Control Globals.grsc\\SequencesList Borders"
  Tag Read(ref in=w11) -> (Data=w12)
  w13 = "TestExec\\Global Controls\\Control Globals.grsc\\Threads Borders"
  Tag Read(ref in=w13) -> (Data=w14)
  w15 = "TestExec\\Global Controls\\Control Globals.grsc\\CallStack Borders"
  Tag Read(ref in=w15) -> (Data=w16)
  w17 = "TestExec\\Global Controls\\Control Globals.grsc\\ListBar Borders"
  Tag Read(ref in=w17) -> (Data=w18)
  call "Close Borders Reference.gvi"(Borders Ref=w18, error in (no error)=$"error in (no error)") -> (error out=w19)
  call "Close Borders Reference.gvi"(Borders Ref=w16, error in (no error)=w19) -> (error out=w20)
  call "Close Borders Reference.gvi"(Borders Ref=w14, error in (no error)=w20) -> (error out=w21)
  call "Close Borders Reference.gvi"(Borders Ref=w12, error in (no error)=w21) -> (error out=w22)
  call "Close Borders Reference.gvi"(Borders Ref=w10, error in (no error)=w22) -> (error out=w23)
  call "Close Borders Reference.gvi"(Borders Ref=w8, error in (no error)=w23) -> (error out=w24)
  call "Close Borders Reference.gvi"(Borders Ref=w6, error in (no error)=w24) -> (error out=w25)
  call "Close Borders Reference.gvi"(Borders Ref=w4, error in (no error)=w25) -> (error out=w26)
  call "Close Borders Reference.gvi"(Borders Ref=w2, error in (no error)=w26) -> (error out=w27)
  $"error out" <- w27
