vi "Close Borders Reference.gvi"   [LabVIEW NXG 2.0.0]
inputs:
  "Borders Ref": COM
  "error in (no error)": error
outputs:
  "error out": error
diagram:
  Is Not A Number Or Path Or Refnum(number=$"Borders Ref") -> w1
  case (w1) {
    frame False, Default {
      Close Reference(reference=$"Borders Ref")
    }
    frame True { }
  }
  # For order of execution only!
  $"error out" <- $"error in (no error)"
