vi "Close Launcher VI Panel.gvi"   [LabVIEW NXG 2.0.0]
inputs:
  "error in (no error)": error
outputs:
  "error out": error
uses:
  NI::G Core::Error::Clear Error Cluster.gvi
diagram:
  w1 = "TestExec\\Global Controls\\Control Globals.grsc\\Launcher VI Refnum"
  Tag Read(ref in=w1) -> (Data=w2)
  Is Not A Number Or Path Or Refnum(number=w2)
  # 6. Close panel of launcher
  # VI if it was used.
  # Close launcher even if there is
  # an error in.
  case (TRUE) {
    frame False, Default {
      Property Node(instance in=w2) -> ("Panel"=w4, error out=w5)
      Property Node(instance in=w4, error in=w5) -> ("Window"=w6, error out=w7)
      # Close launcher
      # VI panel.
      Close Window(error in=w7, reference in=w6)
      call "Clear Error Cluster.gvi"(error in=$"error in (no error)") -> (error out=w3)
    }
    frame True {
      w3 = $"error in (no error)"
    }
  }
  Merge Errors(w3, $"error in (no error)") -> (error out=w8)
  $"error out" <- w8
