vi "Configure Application Manager.gvi"   [LabVIEW NXG 2.0.0]
inputs:
  "error in (no error)": error
outputs:
  "error out": error
uses:
  Component::UI Controls::IApplicationMgr::IApplicationMgr.GetEngine.gvi
diagram:
  # This VI configures the settings for the application:
  #
  # - Have the user interface reload previously open
  # sequence files.
  # - Allow the user interface to honor persisted
  # breakpoints.
  case ($"error in (no error)") {
    frame No Error {
      w2 = "TestExec\\Global Controls\\Control Globals.grsc\\Application Manager"
      Tag Read(ref in=w2) -> (Data=w3)
      Property Node(instance in=w3, "IsEditor"=TRUE) -> (instance out=w4)
      Property Node(instance in=w4, "ReloadSequenceFilesOnStart"="ReloadFile_None"(0), error in=$"error in (no error)") -> (error out=w5, instance out=w6)
      call "IApplicationMgr.GetEngine.gvi"(reference in=w6, error in=w5) -> (error out=w7, return=w8)
      Property Node(instance in=w8, "PersistBreakpoints"=TRUE, error in=w7) -> (error out=w9, instance out=w10)
      Close Reference(error in=w9, reference=w10) -> (error out=w1)
    }
    frame Error {
      w1 = $"error in (no error)"
    }
  }
  $"error out" <- w1
