vi "Configure Engine Environment Menu item.gvi"   [LabVIEW NXG 2.0.0]
inputs:
  "Menu Refnum In": "ApplicationMenu reference"
  "error in (no error)": error
outputs:
  "Menu Refnum Out": "ApplicationMenu reference"
  "Commands out": "TestStand - Commands.gtype"[]
  "error out": error
types:
  "TestStand - Commands.gtype" = i32
  T1 = cluster{"include Shift key?": bool, "include Ctrl key?": bool, "shortcut key": string}
uses:
  Component::UI Controls::IApplicationMgr::IApplicationMgr.GetEngine.gvi
  TSUtility::TestStand - Get Resource String.gvi
diagram:
  w1 = "TestExec\\Global Controls\\Control Globals.grsc\\Application Manager"
  Tag Read(ref in=w1) -> (Data=w2)
  Property Node(instance in=w2, error in=$"error in (no error)") -> ("IsEditor"=w3, instance out=w4)
  # Handle the configure environment menu.  This option is handled differently based on whether the UI is running in the LabVIEW development system or as a built applicaiton
  disable {
    frame RUN_TIME_ENGINE=="True" {
      case (w3) {
        frame False, Default {
          w7 = default
        }
        frame True {
          w8 = "CommandKind_ConfigureEngineEnvironment"(94)  # TestStand - Commands
          Build Array(w8) -> w7
        }
      }
      w5 = $"Menu Refnum In"
      w6 = default
    }
    frame 1, Default {
      call "IApplicationMgr.GetEngine.gvi"(reference in=w4) -> (return=w9)
      case (w3) {
        frame False, Default {
          # not in editor mode, remove the environment menu
          Delete Menu Items(items="CONFIGENVIRONMENT", menu tag="CONFIGURE", reference in=$"Menu Refnum In") -> (reference out=w5)
          w10 = default
          w11 = w9
        }
        frame True {
          # in editor mode; add the menu if it is not present
          Property Node(instance in=w9) -> ("CurrentUser"=w12, error out=w13, instance out=w11)
          Is Not A Number Or Path Or Refnum(number=w12) -> w14
          case (w14) {
            frame False, Default {
              Close Reference(error in=w13, reference=w12)
            }
            frame True { }
          }
          Get Menu Item Info(itemTag="CONFIGENVIRONMENT", reference in=$"Menu Refnum In") -> (error out=w15, reference out=w16, shortcut=w17)
          case (w15) {
            frame No Error {
              w18 = w16
              w10 = default
            }
            frame Error {
              call "TestStand - Get Resource String.gvi"(Engine Reference In=w9, Category="TSUI_COMMANDS", Symbol="TS_CONFIGURE_ENGINE_ENVIRONMENT", Default String="Environment...") -> (Engine Reference Out=w19, Resource String=w20, Error Out=w21)
              Close Reference(error in=w21, reference=w19) -> (error out=w22)
              Insert Menu Items(error in=w22, item names=w20, item tags="CONFIGENVIRONMENT", menu tag="CONFIGURE", reference in=w16) -> (error out=w10, reference out=w18)
            }
          }
          Not(x=w14) -> w23
          Set Menu Item Info(enabled=w23, itemTag="CONFIGENVIRONMENT", reference in=w18) -> (reference out=w5)
          Coerce To Type(type=T1 {all zero or empty}, x=w17)
        }
      }
      Close Reference(error in=w10, reference=w11) -> (error out=w6)
      w7 = default
    }
  }
  $"Menu Refnum Out" <- w5
  $"error out" <- w6
  $"Commands out" <- w7
