vi "Configure Event Callbacks.gvi"   [LabVIEW NXG 2.0.0]
inputs:
  "LabVIEW Events": "LabVIEW Events.gtype"
  "error in (no error)": error
outputs:
  "Event Registration Refs": "CoreRuntime.EventCallbackRefnum"[]
  "error out": error
types:
  "LabVIEW Events.gtype" = cluster{"Quit Application Event": "event Quit Application Event", "ReDraw Event": "event ReDraw", "Config Tab Event": "event Switch Tab Event"}
uses:
  TestExec::Dependencies::Callbacks::ExitApplication Event.gvi
  TestExec::Dependencies::Callbacks::Wait Event.gvi
  TestExec::Dependencies::Callbacks::DisplayExecution Event.gvi
  TestExec::Dependencies::Callbacks::DisplaySequenceFile Event.gvi
  TestExec::Dependencies::Callbacks::DisplayReport Event.gvi
  TestExec::Dependencies::Callbacks::StartExecution Event.gvi
  TestExec::Dependencies::Callbacks::PostCommandExecute Event.gvi
  TestExec::Dependencies::Callbacks::User Changed.gvi
  TestExec::Dependencies::Callbacks::ExecutionChanged Event.gvi
  TestExec::Dependencies::Callbacks::CurPageChanged Event.gvi
  TestExec::Dependencies::Callbacks::Resized Event.gvi
  TestExec::Dependencies::Callbacks::SequenceView CreateContextMenu Event.gvi
  TestExec::Dependencies::Callbacks::ExecutionView CreateContextMenu Event.gvi
  TestExec::Dependencies::Callbacks::ListBar CreateContextMenu Event.gvi
  TestExec::Dependencies::Callbacks::SequencesList CreateContextMenu Event.gvi
  TestExec::Dependencies::Callbacks::TitleBar Requires Update.gvi
  TestExec::Dependencies::Callbacks::File Steps KeyDown Event.gvi
  TestExec::Dependencies::Callbacks::Sequences List KeyDown Event.gvi
  TestExec::Dependencies::Callbacks::File Variables KeyDown Event.gvi
  TestExec::Dependencies::Callbacks::Insertion Palette KeyDown Event.gvi
diagram:
  # 1. Use an array to store the event registration references.  If the reference is wired through each register event callback node, only the events in the last node are registered.
  # This VI registers the VIs that are called when the various TestStand
  # User Interface controls generate ActiveX events.
  case ($"error in (no error)") {
    frame No Error {
      call "ExitApplication Event.gvi"() -> (VIReference=w3)
      call "Wait Event.gvi"() -> (VIReference=w4)
      call "DisplayExecution Event.gvi"() -> (VIReference=w5)
      call "DisplaySequenceFile Event.gvi"() -> (VIReference=w6)
      call "DisplayReport Event.gvi"() -> (VIReference=w7)
      call "StartExecution Event.gvi"() -> (VIReference=w8)
      call "PostCommandExecute Event.gvi"() -> (VIReference=w9)
      call "User Changed.gvi"() -> (VIReference=w10)
      w11 = "TestExec\\Global Controls\\Control Globals.grsc\\Application Manager"
      Tag Read(ref in=w11) -> (Data=w12)
      Register Event Callback(w12, w3, $"LabVIEW Events", w12, w4, $"LabVIEW Events", w12, w5, $"LabVIEW Events", w12, w6, $"LabVIEW Events", w12, w7, $"LabVIEW Events", w12, w8, $"LabVIEW Events", w12, w9, $"LabVIEW Events", w12, w10, $"LabVIEW Events", error in=$"error in (no error)") -> (error out=w13, event callback ref out=w14)  # Register AppManager Events
      call "ExecutionChanged Event.gvi"() -> (VIReference=w15)
      call "CurPageChanged Event.gvi"() -> (VIReference=w16)
      call "Resized Event.gvi"() -> (VIReference=w17)
      call "SequenceView CreateContextMenu Event.gvi"() -> (VIReference=w18)
      call "ExecutionView CreateContextMenu Event.gvi"() -> (VIReference=w19)
      call "ListBar CreateContextMenu Event.gvi"() -> (VIReference=w20)
      call "SequencesList CreateContextMenu Event.gvi"() -> (VIReference=w21)
      call "TitleBar Requires Update.gvi"() -> (VIReference=w22)
      w23 = "TestExec\\Global Controls\\Control Globals.grsc\\Execution View Manager"
      Tag Read(ref in=w23) -> (Data=w24)
      Tag Read(ref in="TestExec\\Global Controls\\Control Globals.grsc\\ListBar") -> (Data=w25)
      Tag Read(ref in="TestExec\\Global Controls\\Control Globals.grsc\\StatusBar") -> (Data=w26)
      Tag Read(ref in="TestExec\\Global Controls\\Control Globals.grsc\\FileSteps") -> (Data=w27)
      w28 = "TestExec\\Global Controls\\Control Globals.grsc\\Execution Steps"
      Tag Read(ref in=w28) -> (Data=w29)
      Tag Read(ref in="TestExec\\Global Controls\\Control Globals.grsc\\ListBar") -> (Data=w30)
      w31 = "TestExec\\Global Controls\\Control Globals.grsc\\SequencesList"
      Tag Read(ref in=w31) -> (Data=w32)
      w33 = "TestExec\\Global Controls\\Control Globals.grsc\\SequenceFile Label"
      Tag Read(ref in=w33) -> (Data=w34)
      w35 = "TestExec\\Global Controls\\Control Globals.grsc\\Execution Label"
      Tag Read(ref in=w35) -> (Data=w36)
      Register Event Callback(w24, w15, $"LabVIEW Events", w25, w16, $"LabVIEW Events", w26, w17, $"LabVIEW Events", w27, w18, $"LabVIEW Events", w29, w19, $"LabVIEW Events", w30, w20, $"LabVIEW Events", w32, w21, $"LabVIEW Events", w34, w22, $"LabVIEW Events", w36, w22, $"LabVIEW Events", error in=w13) -> (error out=w37, event callback ref out=w38)  # Register Other Events
      call "File Steps KeyDown Event.gvi"() -> (VIReference=w39)
      call "Sequences List KeyDown Event.gvi"() -> (VIReference=w40)
      call "File Variables KeyDown Event.gvi"() -> (VIReference=w41)
      call "Insertion Palette KeyDown Event.gvi"() -> (VIReference=w42)
      Tag Read(ref in="TestExec\\Global Controls\\Control Globals.grsc\\FileSteps") -> (Data=w43)
      w44 = "TestExec\\Global Controls\\Control Globals.grsc\\SequencesList"
      Tag Read(ref in=w44) -> (Data=w45)
      w46 = "TestExec\\Global Controls\\Control Globals.grsc\\File Variables"
      Tag Read(ref in=w46) -> (Data=w47)
      w48 = "TestExec\\Global Controls\\Control Globals.grsc\\InsertionPalette"
      Tag Read(ref in=w48) -> (Data=w49)
      Register Event Callback(w43, w39, _, w45, w40, _, w47, w41, _, w49, w42, _, error in=w37) -> (error out=w1, event callback ref out=w50)  # Register KeyDown Events
      # 1.
      Build Array(w14, w38, w50) -> w2
    }
    frame Error {
      w1 = $"error in (no error)"
      w2 = default
    }
  }
  $"Event Registration Refs" <- w2
  $"error out" <- w1
