vi "Configure ExecutionView Manager.gvi"   [LabVIEW NXG 2.0.0]
inputs:
  "error in (no error)": error
outputs:
  "error out": error
uses:
  Component::UI Controls::IExecutionViewMgr::IExecutionViewMgr.ConnectThreadList.gvi
  Component::UI Controls::IExecutionViewMgr::IExecutionViewMgr.ConnectCallStack.gvi
  Component::UI Controls::IExecutionViewMgr::IExecutionViewMgr.ConnectExecutionView.gvi
  Component::UI Controls::IExecutionViewMgr::IExecutionViewMgr.ConnectCommand.gvi
  Component::UI Controls::IExecutionViewMgr::IExecutionViewMgr.ConnectReportView.gvi
  Component::UI Controls::IExecutionViewMgr::IExecutionViewMgr.ConnectVariables.gvi
  Component::UI Controls::IExecutionViewMgr::IExecutionViewMgr.ConnectCaption.gvi
diagram:
  # This VI configures the Connections and Commands for the ExecutionView Manager.
  # Note: The output connection references from the Connection Methods only need to be explicitly closed if they are wired to another node.  Otherwise, LabVIEW automatically closes the references
  case ($"error in (no error)") {
    frame No Error {
      Tag Read(ref in="TestExec\\Global Controls\\Control Globals.grsc\\Threads") -> (Data=w2)
      w3 = "TestExec\\Global Controls\\Control Globals.grsc\\Execution View Manager"
      Tag Read(ref in=w3) -> (Data=w4)
      call "IExecutionViewMgr.ConnectThreadList.gvi"(reference in=w4, error in=$"error in (no error)", uiObj=w2) -> (reference out=w5, error out=w6)
      Tag Read(ref in="TestExec\\Global Controls\\Control Globals.grsc\\CallStack") -> (Data=w7)
      call "IExecutionViewMgr.ConnectCallStack.gvi"(reference in=w5, error in=w6, uiObj=w7) -> (reference out=w8, error out=w9)
      w10 = "TestExec\\Global Controls\\Control Globals.grsc\\Execution Steps"
      Tag Read(ref in=w10) -> (Data=w11)
      call "IExecutionViewMgr.ConnectExecutionView.gvi"(reference in=w8, error in=w9, uiObj=w11, opts=0) -> (reference out=w12, error out=w13)
      w14 = "TestExec\\Global Controls\\Control Globals.grsc\\Break_Resume Button"
      Tag Read(ref in=w14) -> (Data=w15)
      call "IExecutionViewMgr.ConnectCommand.gvi"(opts=0, reference in=w12, error in=w13, uiObj=w15, cmdKind="CommandKind_BreakResume"(72), Index=0) -> (reference out=w16, error out=w17)
      w18 = "TestExec\\Global Controls\\Control Globals.grsc\\Terminate_Restart Button"
      Tag Read(ref in=w18) -> (Data=w19)
      call "IExecutionViewMgr.ConnectCommand.gvi"(opts=0, reference in=w16, error in=w17, uiObj=w19, cmdKind="CommandKind_TerminateRestart"(74), Index=0) -> (reference out=w20, error out=w21)
      w22 = "TestExec\\Global Controls\\Control Globals.grsc\\ReportView"
      Tag Read(ref in=w22) -> (Data=w23)
      call "IExecutionViewMgr.ConnectReportView.gvi"(reference in=w20, error in=w21, uiObj=w23) -> (reference out=w24, error out=w25)
      w26 = "TestExec\\Global Controls\\Control Globals.grsc\\Execution Variables"
      Tag Read(ref in=w26) -> (Data=w27)
      call "IExecutionViewMgr.ConnectVariables.gvi"(reference in=w24, error in=w25, uiObj=w27) -> (reference out=w28, error out=w29)
      w30 = "TestExec\\Global Controls\\Control Globals.grsc\\Execution Label"
      Tag Read(ref in=w30) -> (Data=w31)
      call "IExecutionViewMgr.ConnectCaption.gvi"(reference in=w28, error in=w29, uiObj=w31, captionSource="CaptionSource_CurrentExecution"(24), longName in=FALSE) -> (error out=w1)
    }
    frame Error {
      w1 = $"error in (no error)"
    }
  }
  $"error out" <- w1
