vi "Configure ListBar.gvi"   [LabVIEW NXG 2.0.0]
inputs:
  "error in (no error)": error
outputs:
  "error out": error
uses:
  Component::UI Controls::ListBarPages::ListBarPages.Item.gvi
  Component::UI Controls::ISequenceFileViewMgr::ISequenceFileViewMgr.ConnectSequenceFileList.gvi
  Component::UI Controls::IExecutionViewMgr::IExecutionViewMgr.ConnectExecutionList.gvi
diagram:
  # This VI configures the Connections for the ListBar.
  case ($"error in (no error)") {
    frame No Error {
      Tag Read(ref in="TestExec\\Global Controls\\Control Globals.grsc\\ListBar") -> (Data=w2)
      Property Node(instance in=w2, error in=$"error in (no error)") -> ("Pages"=w3, error out=w4)
      call "ListBarPages.Item.gvi"(reference in=w3, error in=w4, itemIdx=0) -> (reference out=w5, error out=w6, return=w7)
      w8 = "TestExec\\Global Controls\\Control Globals.grsc\\Sequence File View Manager"
      Tag Read(ref in=w8) -> (Data=w9)
      call "ISequenceFileViewMgr.ConnectSequenceFileList.gvi"(reference in=w9, error in=w6, uiObj=w7, fullPath in=FALSE) -> (error out=w10)
      Close Reference(error in=w10, reference=w7) -> (error out=w11)
      call "ListBarPages.Item.gvi"(reference in=w5, error in=w11, itemIdx=1) -> (reference out=w12, error out=w13, return=w14)
      w15 = "TestExec\\Global Controls\\Control Globals.grsc\\Execution View Manager"
      Tag Read(ref in=w15) -> (Data=w16)
      call "IExecutionViewMgr.ConnectExecutionList.gvi"(reference in=w16, error in=w13, uiObj=w14) -> (error out=w17, return=w18)
      w19 = "\"%CurrentExecution%\\n\" + (\"%UUTSerialNumber%\" == \"\" ? \"\" : (ResStr(\"TSUI_OI_MAIN_PANEL\", \"SERIAL_NUMBER\") + \" %UUTSerialNumber%\\n\")) + (\"%TestSocketIndex%\" == \"\" ? \"\" : ResStr(\"TSUI_OI_MAIN_PANEL\", \"SOCKET_NUMBER\") + \" %TestSocketIndex%\\n\") + \"%ModelState%\""
      Close Reference(error in=w17, reference=w14) -> (error out=w20)
      Property Node(instance in=w18, "DisplayExpression"=w19, error in=w20) -> (error out=w21, instance out=w22)
      Close Reference(error in=w21, reference=w22) -> (error out=w23)
      Close Reference(error in=w23, reference=w12) -> (error out=w1)
    }
    frame Error {
      w1 = $"error in (no error)"
    }
  }
  $"error out" <- w1
