vi "Configure SequenceFileView Manager.gvi"   [LabVIEW NXG 2.0.0]
inputs:
  "error in (no error)": error
outputs:
  "error out": error
uses:
  Component::UI Controls::ISequenceFileViewMgr::ISequenceFileViewMgr.ConnectCommand.gvi
  Component::UI Controls::ISequenceFileViewMgr::ISequenceFileViewMgr.ConnectVariables.gvi
  Component::UI Controls::ISequenceFileViewMgr::ISequenceFileViewMgr.ConnectInsertionPalette.gvi
  Component::UI Controls::ISequenceFileViewMgr::ISequenceFileViewMgr.ConnectSequenceList.gvi
  Component::UI Support Library::SequenceListConnection::SequenceListConnection.SetColumnVisible.gvi
  Component::UI Controls::ISequenceFileViewMgr::ISequenceFileViewMgr.ConnectSequenceView.gvi
  Component::UI Controls::ISequenceFileViewMgr::ISequenceFileViewMgr.ConnectCaption.gvi
diagram:
  # This VI configures the Connections, Commands, and Captions for the SequenceFileView Manager.
  # Note: The output connection references from the Connection Methods only need to be explicitly closed if they are wired to another node.  Otherwise, LabVIEW automatically closes the references
  case ($"error in (no error)") {
    frame No Error {
      w2 = "TestExec\\Global Controls\\Control Globals.grsc\\Sequence File View Manager"
      Tag Read(ref in=w2) -> (Data=w3)
      w4 = "TestExec\\Global Controls\\Control Globals.grsc\\Entry Point 1 Button"
      Tag Read(ref in=w4) -> (Data=w5)
      call "ISequenceFileViewMgr.ConnectCommand.gvi"(opts=0, reference in=w3, error in=$"error in (no error)", uiObj=w5, cmdKind="CommandKind_ExecutionEntryPoints_Set"(141), Index=0) -> (reference out=w6, error out=w7)
      w8 = "TestExec\\Global Controls\\Control Globals.grsc\\Entry Point 2 Button"
      Tag Read(ref in=w8) -> (Data=w9)
      # Connect the Entry Point Buttons using the ExecutionEntryPoints_Set
      # Command. The index parameter specifies which entry point is used.
      call "ISequenceFileViewMgr.ConnectCommand.gvi"(opts=0, reference in=w6, error in=w7, uiObj=w9, cmdKind="CommandKind_ExecutionEntryPoints_Set"(141), Index=1) -> (reference out=w10, error out=w11)
      w12 = "TestExec\\Global Controls\\Control Globals.grsc\\File Variables"
      Tag Read(ref in=w12) -> (Data=w13)
      call "ISequenceFileViewMgr.ConnectVariables.gvi"(reference in=w10, error in=w11, uiObj=w13) -> (reference out=w14, error out=w15)
      w16 = "TestExec\\Global Controls\\Control Globals.grsc\\InsertionPalette"
      Tag Read(ref in=w16) -> (Data=w17)
      call "ISequenceFileViewMgr.ConnectInsertionPalette.gvi"(reference in=w14, error in=w15, uiObj=w17) -> (reference out=w18, error out=w19)
      w20 = "TestExec\\Global Controls\\Control Globals.grsc\\SequencesList"
      Tag Read(ref in=w20) -> (Data=w21)
      call "ISequenceFileViewMgr.ConnectSequenceList.gvi"(reference in=w18, error in=w19, uiObj=w21) -> (reference out=w22, error out=w23, return=w24)
      w25 = "TestExec\\Global Controls\\Control Globals.grsc\\RunSequenceButton"
      Tag Read(ref in=w25) -> (Data=w26)
      Is Not A Number Or Path Or Refnum(number=w24) -> w27
      case (w27) {
        frame False, Default {
          call "SequenceListConnection.SetColumnVisible.gvi"(reference in=w24, error in=w23, column="SeqListConnectionColumn_Comments"(1), val=TRUE) -> (reference out=w29, error out=w28)
        }
        frame True {
          w28 = w23
          w29 = w24
        }
      }
      Close Reference(error in=w28, reference=w29) -> (error out=w30)
      call "ISequenceFileViewMgr.ConnectCommand.gvi"(opts=0, reference in=w22, error in=w30, uiObj=w26, cmdKind="CommandKind_RunCurrentSequence"(44), Index=0) -> (reference out=w31, error out=w32)
      Tag Read(ref in="TestExec\\Global Controls\\Control Globals.grsc\\FileSteps") -> (Data=w33)
      call "ISequenceFileViewMgr.ConnectSequenceView.gvi"(reference in=w31, error in=w32, uiObj=w33) -> (reference out=w34, error out=w35)
      w36 = "TestExec\\Global Controls\\Control Globals.grsc\\SequenceFile Label"
      Tag Read(ref in=w36) -> (Data=w37)
      call "ISequenceFileViewMgr.ConnectCaption.gvi"(reference in=w34, error in=w35, uiObj=w37, captionSource="CaptionSource_CurrentSequenceFile"(11), longName in=FALSE) -> (error out=w1)
    }
    frame Error {
      w1 = $"error in (no error)"
    }
  }
  $"error out" <- w1
