vi "Configure StatusBar.gvi"   [LabVIEW NXG 2.0.0]
inputs:
  "error in (no error)": error
outputs:
  "error out": error
uses:
  Component::UI Controls::StatusBarPanes::StatusBarPanes.Item.gvi
  Component::UI Controls::IApplicationMgr::IApplicationMgr.ConnectCaption.gvi
  Component::UI Controls::IExecutionViewMgr::IExecutionViewMgr.ConnectCaption.gvi
  Component::UI Controls::ISequenceFileViewMgr::ISequenceFileViewMgr.ConnectCaption.gvi
  Component::UI Controls::IExecutionViewMgr::IExecutionViewMgr.ConnectNumeric.gvi
diagram:
  # This VI configures the Connections for the StatusBar.
  case ($"error in (no error)") {
    frame No Error {
      w2 = "TestExec\\Global Controls\\Control Globals.grsc\\Sequence File View Manager"
      Tag Read(ref in=w2) -> (Data=w3)
      Tag Read(ref in="TestExec\\Global Controls\\Control Globals.grsc\\StatusBar") -> (Data=w4)
      Property Node(instance in=w4, error in=$"error in (no error)") -> ("Panes"=w5, error out=w6)
      call "StatusBarPanes.Item.gvi"(reference in=w5, error in=w6, paneIndex="User") -> (reference out=w7, error out=w8, return=w9)
      w10 = "TestExec\\Global Controls\\Control Globals.grsc\\Execution View Manager"
      Tag Read(ref in=w10) -> (Data=w11)
      w12 = [{"captionSource"=34, "LongName"=FALSE, "PaneName"="EngineEnvironment"}, {"captionSource"=27, "LongName"=FALSE, "PaneName"="ExecutionModel"}, {"captionSource"=20, "LongName"=FALSE, "PaneName"="ExecutionSelectedSteps"}, {"captionSource"=22, "LongName"=FALSE, "PaneName"="ExecutionNumberOfSteps"}, {"captionSource"=28, "LongName"=TRUE, "PaneName"="ReportLocation"}, {"captionSource"=9, "LongName"=FALSE, "PaneName"="ProgressText"}, {"captionSource"=10, "LongName"=FALSE, "PaneName"="ProgressPercent"}]
      w13 = "TestExec\\Global Controls\\Control Globals.grsc\\Application Manager"
      Tag Read(ref in=w13) -> (Data=w14)
      call "IApplicationMgr.ConnectCaption.gvi"(reference in=w14, error in=w8, uiObj=w9, captionSource="CaptionSource_UserName"(8), longName in=TRUE) -> (error out=w15)
      Close Reference(error in=w15, reference=w9) -> (error out=w16)
      s1 = w16  # shift register
      s2 = w7  # shift register
      for {  # Execution View Manager connections
        w17 = each element of w12
        Property Node(instance in=w17) -> ("PaneName"=w18, "captionSource"=w19, "LongName"=w20)
        call "StatusBarPanes.Item.gvi"(reference in=s2, error in=s1, paneIndex=w18) -> (reference out=w21, error out=w22, return=w23)
        call "IExecutionViewMgr.ConnectCaption.gvi"(reference in=w11, error in=w22, uiObj=w23, captionSource=w19, longName in=w20) -> (error out=w24)
        Close Reference(error in=w24, reference=w23) -> (error out=w25)
        next s1 = w25
        next s2 = w21
      }
      w26 = [{"captionSource"=27, "LongName"=FALSE, "PaneName"="FileModel"}, {"captionSource"=20, "LongName"=FALSE, "PaneName"="FileSelectedSteps"}, {"captionSource"=22, "LongName"=FALSE, "PaneName"="FileNumberOfSteps"}]
      s3 = s1  # shift register
      s4 = s2  # shift register
      for {  # Sequence File View Manager connections
        w27 = each element of w26
        Property Node(instance in=w27) -> ("PaneName"=w28, "captionSource"=w29, "LongName"=w30)
        call "StatusBarPanes.Item.gvi"(reference in=s4, error in=s3, paneIndex=w28) -> (reference out=w31, error out=w32, return=w33)
        call "ISequenceFileViewMgr.ConnectCaption.gvi"(reference in=w3, error in=w32, uiObj=w33, captionSource=w29, longName in=w30) -> (error out=w34)
        Close Reference(error in=w34, reference=w33) -> (error out=w35)
        next s3 = w35
        next s4 = w31
      }
      call "StatusBarPanes.Item.gvi"(reference in=s4, error in=s3, paneIndex="ProgressPercent") -> (reference out=w36, error out=w37, return=w38)
      call "IExecutionViewMgr.ConnectNumeric.gvi"(reference in=w11, error in=w37, uiObj=w38, numericSource="NumericSource_ProgressPercent"(10)) -> (reference out=w39, error out=w40)
      Close Reference(error in=w40, reference=w39) -> (error out=w41)
      Close Reference(error in=w41, reference=w36) -> (error out=w1)
    }
    frame Error {
      w1 = $"error in (no error)"
    }
  }
  $"error out" <- w1
