vi "Create LabVIEW Application Events.gvi"   [LabVIEW NXG 2.0.0]
inputs:
  "error in (no error)": error
outputs:
  "LabVIEW Events": "LabVIEW Events.gtype"
  "Event Registration Refnum": "CoreRuntime.EventRegistrationRefnum"
  "error out": error
types:
  "LabVIEW Events.gtype" = cluster{"Quit Application Event": "event Quit Application Event", "ReDraw Event": "event ReDraw", "Config Tab Event": "event Switch Tab Event"}
diagram:
  # Create Quit Application user event
  # that is used in the callback for the
  # ExitApplication event.
  case ($"error in (no error)") {
    frame No Error {
      w4 = cluster{"Number": i32} {all zero or empty}  # Quit Application Event
      Create User Event[EventName="Quit Application Event"](error in=$"error in (no error)", user event data type=w4) -> (error out=w5, user event out=w6)
      w7 = cluster{"Number": i32} {all zero or empty}  # ReDraw Event
      Create User Event[EventName=ReDraw](error in=w5, user event data type=w7) -> (error out=w8, user event out=w9)
      w10 = cluster{"Active Tab": i32} {all zero or empty}  # Switch Tab Event
      Create User Event[EventName="Switch Tab Event"](error in=w8, user event data type=w10) -> (error out=w11, user event out=w12)
      Register For Events("Quit Application Event"=w6, "ReDraw"=w9, "Switch Tab Event"=w12, error in=w11) -> (error out=w2, event registration refnum out=w1)
      Property Node(instance in="LabVIEW Events.gtype" {all zero or empty}, "Quit Application Event"=w6, "ReDraw Event"=w9, "Config Tab Event"=w12) -> (instance out=w3)
    }
    frame Error {
      w1 = default
      w2 = $"error in (no error)"
      w3 = default
    }
  }
  $"Event Registration Refnum" <- w1
  $"error out" <- w2
  $"LabVIEW Events" <- w3
