vi "Display Error.gvi"   [LabVIEW NXG 2.0.0]
inputs:
  "Try Getting Error String from Engine (True)": bool = TRUE
  "error in (no error)": error
outputs:
  "cleared error out": error
uses:
  Component::UI Controls::IApplicationMgr::IApplicationMgr.GetEngine.gvi
  Component::Engine::IEngine::IEngine.GetErrorString.gvi
  TestExec::Global Controls::LabVIEW.sli::GGetOneErrorCode
  TSUtility::TestStand - Get Resource String.gvi
  NI::G Core::Error::Clear Error Cluster.gvi
  Component::Engine::IEngine::IEngine.DisplayMessageBox.gvi
diagram:
  # This VI displays an error dialog in the event of an error.
  case ($"error in (no error)") {
    frame No Error {
      w1 = $"error in (no error)"
    }
    frame Error {
      w2 = "TestExec\\Global Controls\\Control Globals.grsc\\Application Manager"
      Tag Read(ref in=w2) -> (Data=w3)
      call "IApplicationMgr.GetEngine.gvi"(reference in=w3) -> (error out=w4, return=w5)
      case ($"Try Getting Error String from Engine (True)") {
        frame False, Default {
          Property Node(instance in=$"error in (no error)") -> ("source"=w9)
          w6 = FALSE
          w7 = w4
          w8 = w5
        }
        frame True {
          Property Node(instance in=$"error in (no error)") -> ("code"=w10, "source"=w11)
          call "IEngine.GetErrorString.gvi"(reference in=w5, error in=w4, errorCode=w10) -> (reference out=w8, error out=w7, errorString=w12, return=w6)
          Concatenate Strings(w11, "\n", "\n", w12) -> w9
        }
      }
      case (w6) {
        frame False, Default {
          # Not a TestStand error. Try Updating using LV
          # error DB.  Note that this error msg will not be localized
          # unless customer is using a localized version of LabVIEW.
          Property Node(instance in=$"error in (no error)") -> ("source"=w14, "code"=w15)
          call "GGetOneErrorCode"(errorCode in=w15, arg in="") -> (return=w16, arg out=w17)
          Is Equal To 0(x=w16) -> w18
          Select(s=w18, t=w14, f=w17) -> w13
        }
        frame True {
          w13 = w9
        }
      }
      # TestStand error. Simply display
      # the error message. Use a
      # localized string for the error dialog
      # title.
      call "TestStand - Get Resource String.gvi"(Engine Reference In=w8, Category="TSUI_OI_MAIN_PANEL", Symbol="ERR_BOX_TITLE", Error In=w7, Default String="Error") -> (Engine Reference Out=w19, Resource String=w20, Error Out=w21)
      Is Not A Number Or Path Or Refnum(number=w19) -> w22
      case (w22) {
        frame False, Default {
          call "Clear Error Cluster.gvi"(error in=w21) -> (error out=w23)
          # Display error even if localization failed
          call "IEngine.DisplayMessageBox.gvi"(reference in=w19, error in=w23, dlgTitle=w20, messageText=w13, msgBoxType="MsgBox_Error"(2)) -> (reference out=w24, error out=w25)
          Close Reference(error in=w25, reference=w24) -> (error out=w1)
        }
        frame True {
          # Couldn't even get an
          # engine ref, just display
          # message with LV dialog
          call "Clear Error Cluster.gvi"(error in=w21) -> (error out=w1)
          One Button Dialog(message=w13)
        }
      }
    }
  }
  call "Clear Error Cluster.gvi"(error in=w1) -> (error out=w26)
  $"cleared error out" <- w26
