vi "Find Menu Tags with Command Type.gvi"   [LabVIEW NXG 2.0.0]
inputs:
  "Menu Refnum In": "ApplicationMenu reference"
  "Kind to Find": "TestStand - Commands.gtype" = "CommandKind_NotACommand"(0)
outputs:
  "Tags of Command Type": string[]
types:
  "TestStand - Commands.gtype" = i32
  T1 = cluster{"include Shift key?": bool, "include Ctrl key?": bool, "shortcut key": string}
uses:
  TSUtility::TestStand - Menu Command Data.gvi
diagram:
  Get Menu Item Info(reference in=$"Menu Refnum In") -> (shortcut=w1, subMenuTags=w2)
  s1 = string[] []  # shift register
  for {
    w3 = each element of w2
    Get Menu Item Info(itemTag=w3, reference in=$"Menu Refnum In") -> (error out=w4, shortcut=w5, subMenuTags=w6)
    s2 = w4  # shift register
    s3 = s1  # shift register
    for (after $"Menu Refnum In") {
      w7 = each element of w6
      call "TestStand - Menu Command Data.gvi"(Operation="Get Menu Command", Menu Tag=w7, error in (no error)=s2) -> (Menu Command Out=w8, error out=w9)
      Property Node(instance in=w8, error in=w9) -> ("Kind"=w10, error out=w11)
      Is Equal(x=w10, y=$"Kind to Find") -> w12
      case (w12) {
        frame False, Default {
          w13 = s3
        }
        frame True {
          Build Array[ConcatenateInputs=True](s3, w7) -> w13
        }
      }
      next s2 = w11
      next s3 = w13
    }
    Coerce To Type(type=T1 {all zero or empty}, x=w5)
    next s1 = s3
  }
  $"Tags of Command Type" <- s1
  Coerce To Type(type=T1 {all zero or empty}, x=w1)
