vi "Get Tab Control Value for Execution.gvi"   [LabVIEW NXG 2.0.0]
inputs:
  "Execution In": COM
  "error in (no error)": error
outputs:
  "Execution Out": COM
  "Tab Control Value": i32
  "error out": error
uses:
  Component::Engine::Execution::Execution.AsPropertyObject.gvi
  Component::Engine::PropertyObject::PropertyObject.GetValNumber.gvi
diagram:
  $"Execution Out" <- $"Execution In"
  # Get the value of the tab control from the last
  # time the execution was viewed.
  #
  # Note: This VI is marked to be reentrant since it is
  # shared by multiple event callback VIs.
  case ($"error in (no error)") {
    frame No Error {
      call "Execution.AsPropertyObject.gvi"(reference in=$"Execution In", error in=$"error in (no error)") -> (error out=w3, return=w4)
      call "PropertyObject.GetValNumber.gvi"(reference in=w4, error in=w3, lookupString="NIUI.LastActiveTab", options=0x1) -> (reference out=w5, error out=w6, return=w1)
      Close Reference(error in=w6, reference=w5) -> (error out=w2)
    }
    frame Error {
      w1 = default
      w2 = $"error in (no error)"
    }
  }
  $"Tab Control Value" <- w1
  $"error out" <- w2
