vi "Get and Set Control Focus.gvi"   [LabVIEW NXG 2.0.0]
inputs:
  "Operation": enum{"Get Focus", "Set Focus"} = "Get Focus"
  "hWnd": i32
  "error in (no error)": error
outputs:
  "hWnd out": i32
  "error out": error
uses:
  TestExec::Global Controls::user32.sli::GetFocus
  TestExec::Global Controls::user32.sli::SetFocus
diagram:
  # This VI gets and sets the current window focus.
  # Use it to set the focus to the correct TestStand
  # User Interface Control.
  #
  # Note: This VI is marked to be reentrant since it is
  # shared by multiple event callback VIs.
  case ($"error in (no error)") {
    frame No Error {
      disable {
        frame Enabled {
          w1 = $hWnd
        }
        frame Disabled {
          case ($Operation) {
            frame "Get Focus" {
              call "GetFocus"() -> (return=w1)
            }
            frame "Set Focus" {
              call "SetFocus"(hWnd in=$hWnd) -> (return=w1)
            }
          }
        }
      }
      w2 = $"error in (no error)"
    }
    frame Error {
      w1 = $hWnd
      w2 = $"error in (no error)"
    }
  }
  $"hWnd out" <- w1
  $"error out" <- w2
