vi "Get original panel State.gvi"   [LabVIEW NXG 2.0.0]
inputs:
  "error in (no error)": error
outputs:
  "Front panel Previously Open": bool
  "error out": error
diagram:
  w1 = "TestExec\\Global Controls\\Control Globals.grsc\\Top Level VI Refnum"
  Tag Read(ref in=w1) -> (Data=w2)
  Property Node(instance in=w2, error in=$"error in (no error)") -> ("Panel"=w3, error out=w4)
  Property Node(instance in=w3, error in=w4) -> ("Window"=w5, error out=w6)
  # 1
  Open Window(error in=w6, reference in=w5) -> (error out=w7)
  $"error out" <- w7
  # We always return false as the window will always be closed.
  # It will only open when after Node(1) is executed.
  $"Front panel Previously Open" <- FALSE
