vi "Initialize.gvi"   [LabVIEW NXG 2.0.0]
# Initialize User Interface
inputs:
  "error in (no error)": error
outputs:
  "FF UI Data Out": "FullUIData.gtype"
  "error out": error
types:
  "LabVIEW Events.gtype" = cluster{"Quit Application Event": "event Quit Application Event", "ReDraw Event": "event ReDraw", "Switch Tab Event": "event Switch Tab Event"}
  "FullUIData.gtype" = cluster{"Front Panel Originally Open": bool, "TestStand Engine": COM, "COM Event Reg Refs": "CoreRuntime.EventCallbackRefnum"[], "LabVIEW Events": "LabVIEW Events.gtype", "Event Registration Refnum": "CoreRuntime.EventRegistrationRefnum"}
uses:
  TestExec::Dependencies::Callbacks::Register Report Error.gvi
  TestExec::Dependencies::Configure Application Manager.gvi
  TestExec::Dependencies::Configure SequenceFileView Manager.gvi
  TestExec::Dependencies::Configure ExecutionView Manager.gvi
  TestExec::Dependencies::Configure ListBar.gvi
  TestExec::Dependencies::Configure StatusBar.gvi
  TestExec::Dependencies::Localize Operator Interface.gvi
  TestExec::Dependencies::Create LabVIEW Application Events.gvi
  TestExec::Dependencies::Configure Event Callbacks.gvi
  TestExec::Dependencies::Get original panel State.gvi
  TestExec::Dependencies::Set Tab Value.gvi
  TestExec::Dependencies::Close Launcher VI Panel.gvi
  Component::UI Controls::IApplicationMgr::IApplicationMgr.Start.gvi
  Component::UI Controls::IApplicationMgr::IApplicationMgr.GetEngine.gvi
diagram:
  # 1 Configure TestStand manager controls and their connections
  # 2 Configure TestStand controls.
  # 3 Localize the front panel and menu bar.
  # 4 Create and register LabVIEW events.
  # 5 Register the VIs to handle events from the TestStand controls.
  # 6 Check if the top level panel is already open
  # 7 Store the current state of the front panel, then load runtime panel and control sizes
  # 8 Close the Launch Panel, and show the main UI panel
  # 9 Start the Application Manager
  # 10 Get a reference to the TestStand Engine
  case ($"error in (no error)") {
    frame No Error {
      call "Register Report Error.gvi"(error in (no error)=$"error in (no error)") -> (error out=w3)
      call "Configure Application Manager.gvi"(error in (no error)=w3) -> (error out=w4)
      # 1
      call "Configure SequenceFileView Manager.gvi"(error in (no error)=w4) -> (error out=w5)
      call "Configure ExecutionView Manager.gvi"(error in (no error)=w5) -> (error out=w6)
      # 2
      call "Configure ListBar.gvi"(error in (no error)=w6) -> (error out=w7)
      call "Configure StatusBar.gvi"(error in (no error)=w7) -> (error out=w8)
      # 3
      call "Localize Operator Interface.gvi"(error in (no error)=w8) -> (error out=w9)
      # 4
      call "Create LabVIEW Application Events.gvi"(error in (no error)=w9) -> (Event Registration Refnum=w10, LabVIEW Events=w11, error out=w12)
      # 5
      call "Configure Event Callbacks.gvi"(LabVIEW Events=w11, error in (no error)=w12) -> (Event Registration Refs=w13, error out=w14)
      # 6
      call "Get original panel State.gvi"(error in (no error)=w14) -> (Front panel Previously Open=w15, error out=w16)
      w17 = "TestExec\\Global Controls\\Control Globals.grsc\\TabCtl Refnum"
      Tag Read(ref in=w17) -> (Data=w18)
      Type Cast(type="TabControl reference" constant, x=w18) -> w19
      # 7
      call "Set Tab Value.gvi"(TabCtl Refnum=w19, Value=0, error in (no error)=w16) -> (error out=w20)
      # 8
      call "Close Launcher VI Panel.gvi"(error in (no error)=w20) -> (error out=w21)
      w22 = "TestExec\\Global Controls\\Control Globals.grsc\\Application Manager"
      Tag Read(ref in=w22) -> (Data=w23)
      # 9
      call "IApplicationMgr.Start.gvi"(reference in=w23, error in=w21) -> (reference out=w24, error out=w25)
      # 10
      call "IApplicationMgr.GetEngine.gvi"(reference in=w24, error in=w25) -> (error out=w1, return=w26)
      Property Node(instance in="FullUIData.gtype" {all zero or empty}, "Front Panel Originally Open"=w15, "LabVIEW Events"=w11, "Event Registration Refnum"=w10, "COM Event Reg Refs"=w13, "TestStand Engine"=w26) -> (instance out=w2)
    }
    frame Error {
      w1 = $"error in (no error)"
      w2 = "FullUIData.gtype" {all zero or empty}
    }
  }
  $"FF UI Data Out" <- w2
  $"error out" <- w1
