vi "Localize Operator Interface.gvi"   [LabVIEW NXG 2.0.0]
inputs:
  "error in (no error)": error
outputs:
  "error out": error
uses:
  Component::UI Controls::IApplicationMgr::IApplicationMgr.LocalizeAllControls.gvi
  Component::UI Controls::IApplicationMgr::IApplicationMgr.GetEngine.gvi
  TSUtility::TestStand - Localize Menu.gvi
  TSUtility::TestStand - Get Resource String.gvi
diagram:
  # This VI localizes all of the TestStand UI Controls as
  # well as the LabVIEW controls and top-level items
  # in the run-time menu.
  case ($"error in (no error)") {
    frame No Error {
      w2 = "TestExec\\Global Controls\\Control Globals.grsc\\Application Manager"
      Tag Read(ref in=w2) -> (Data=w3)
      Property Node(instance in=w3, error in=$"error in (no error)") -> ("IsEditor"=w4, error out=w5, instance out=w6)
      # Localization for strings that are different when we are an editor
      case (w4) {
        frame False, Default {
          w7 = w5
          w8 = w6
        }
        frame True {
          call "IApplicationMgr.LocalizeAllControls.gvi"(reference in=w6, error in=w5, sectionName="TSUI_OI_EDITOR_ABOUT_BOX") -> (reference out=w8, error out=w7)
        }
      }
      call "IApplicationMgr.GetEngine.gvi"(reference in=w8, error in=w7) -> (error out=w9, return=w10)
      w11 = "TestExec\\Global Controls\\Control Globals.grsc\\menu refnum"
      Tag Read(ref in=w11) -> (Data=w12)
      Type Cast(type="ApplicationMenu reference" constant, x=w12) -> w13
      call "TestStand - Localize Menu.gvi"(Engine Reference In=w10, Menu Refnum In=w13, Category="TSUI_OI_MAIN_PANEL", error in (no error)=w9) -> (Engine Reference Out=w14)
      call "TestStand - Get Resource String.gvi"(Engine Reference In=w14, Category="TSUI_OI_MAIN_PANEL", Symbol="TESTSTAND_USER_INTERFACE") -> (Engine Reference Out=w15, Resource String=w16)
      Close Reference(reference=w15) -> (error out=w1)
      w17 = "TestExec\\Global Controls\\Control Globals.grsc\\Top Level VI Refnum"
      Tag Read(ref in=w17) -> (Data=w18)
      Property Node(instance in=w18) -> ("Panel"=w19)
      Property Node(instance in=w19) -> ("Window"=w20)
      Property Node(instance in=w20, "Title"=w16)
    }
    frame Error {
      w1 = $"error in (no error)"
    }
  }
  $"error out" <- w1
