vi "Process Delete Keydown.gvi"   [LabVIEW NXG 2.0.0]
inputs:
  "keyCode": i16
  "shift": i16
outputs:
  "KeyCode out": i16
uses:
  TestExec::Dependencies::Rebuild Menu Bar.gvi
  TestExec::Dependencies::Find Menu Tags with Command Type.gvi
  TSUtility::TestStand - Execute Menu Command.gvi
diagram:
  case ($keyCode) {
    frame 0, Default {
      # Do Nothing
      w1 = $keyCode
    }
    frame 46 {
      w2 = "TestExec\\Global Controls\\Control Globals.grsc\\Application Manager"
      Tag Read(ref in=w2) -> (Data=w3)
      Property Node(instance in=w3) -> ("IsEditor"=w4, instance out=w5)
      case (w4) {
        frame False, Default {
          w1 = $keyCode
        }
        frame True {
          w6 = "TestExec\\Global Controls\\Control Globals.grsc\\TestStand UI Control Has Focus"
          Tag Read(ref in=w6) -> (Data=w7)
          w8 = "TestExec\\Global Controls\\Control Globals.grsc\\menu refnum"
          Tag Read(ref in=w8) -> (Data=w9)
          Type Cast(type="ApplicationMenu reference" constant, x=w9) -> w10
          call "Rebuild Menu Bar.gvi"(Menu Refnum In=w10, TS UI Control Has Focus=w7) -> (Menu Refnum Out=w11, error out=w12)
          # Process Delete Key when in Editor mode
          w13 = "CommandKind_Edit_Delete"(206)  # TestStand - Commands
          call "Find Menu Tags with Command Type.gvi"(Menu Refnum In=w11, Kind to Find=w13) -> (Tags of Command Type=w14)
          Array Index(array=w14) -> (out0[0]=w15)
          call "TestStand - Execute Menu Command.gvi"(Menu Tag In=w15, error in (no error)=w12)
          w1 = $keyCode
        }
      }
    }
  }
  $"KeyCode out" <- w1
