vi "Process User Menus.gvi"   [LabVIEW NXG 3.0.0]
# This VI processes user menu tags.
inputs:
  "Menu Tag": string
  "User Menu Selected": bool
  "error in (no error)": error
outputs:
  "error out": error
uses:
  TestExec::Dependencies::About.gvi
  Component::UI Controls::IApplicationMgr::IApplicationMgr.GetEngine.gvi
  Component::Engine::IEngine::IEngine.DisplayEnvironmentConfigurationDialog.gvi
  TestExec::Dependencies::Display Error.gvi
  Component::UI Controls::IApplicationMgr::IApplicationMgr.GetCommand.gvi
  Component::UI Controls::Command::Command.Execute.gvi
diagram:
  Property Node(instance in=$"error in (no error)") -> ("status"=w1)
  Logical And($"User Menu Selected", not w1) -> w2
  # You can process your custom menu items by adding cases
  # for your menu tags.
  case (w2) {
    frame False, Default {
      # Error or not a
      # user menu
      # do nothing
      w3 = $"error in (no error)"
    }
    frame True {
      case ($"Menu Tag") {
        frame Default {
          # Unhandled Menu Tag
          w3 = $"error in (no error)"
        }
        frame "ABOUT" {
          # About Box
          call "About.gvi"()
          w3 = $"error in (no error)"
        }
        frame "CONFIGENVIRONMENT" {
          w4 = "TestExec::Global Controls::Control Globals.grsc::Application Manager"
          Tag Read(ref in=w4) -> (Data=w5)
          call "IApplicationMgr.GetEngine.gvi"(reference in=w5) -> (reference out=w6, error out=w7, return=w8)
          call "IEngine.DisplayEnvironmentConfigurationDialog.gvi"(reference in=w8, error in=w7) -> (error out=w9, Path out=w10, return=w11)
          # This case is used only when changing environments when running the UI in the LabVIEW development system.
          case (w11) {
            frame False, Default { }
            frame True {
              # Option 0x80 to prepare
              # for a call and forget
              String To Path(string=w10) -> (path=w12)
              Open VI Reference[CallOptions=AsynchronousCallWithoutWait](error in=w9, type specifier VI reference=StrictVIRefnum<"function "> constant, vi name="RunLauncher.gvi") -> (error out=w13, vi reference=w14)
              Call By Reference[CallByReferenceLoadType=0, CallByReferenceStyle=1](L0=w12, error in=w13, #ri=w14) -> (error out=w15, #ro=w16)
              Close Reference(error in=w15, reference=w16) -> (error out=w17)
              call "Display Error.gvi"(Try Getting Error String from Engine (True)=FALSE, error in (no error)=w17) -> (cleared error out=w18)
              call "IApplicationMgr.GetCommand.gvi"(reference in=w6, error in=w18, cmdKind="CommandKind_Exit"(30)) -> (error out=w19, return=w20)
              call "Command.Execute.gvi"(reference in=w20, error in=w19, applicationHandlesError=FALSE) -> (reference out=w21, error out=w22)
              Close Reference(error in=w22, reference=w21)
            }
          }
          w3 = $"error in (no error)"
        }
      }
    }
  }
  $"error out" <- w3
