vi "Rebuild Menu Bar.gvi"   [LabVIEW NXG 3.0.0]
inputs:
  "Menu Refnum In": "ApplicationMenu reference"
  "TS UI Control Has Focus": bool, required
  "error in (no error)": error
outputs:
  "Menu Refnum Out": "ApplicationMenu reference"
  "error out": error
uses:
  TestExec::Dependencies::Configure Engine Environment Menu item.gvi
  TSUtility::TestStand - Remove Commands from Menus.gvi
  TSUtility::TestStand - Insert Commands in Menu (SequenceFileView Manager).gvi
  TSUtility::TestStand - Insert Commands in Menu (ExecutionView Manager).gvi
  TSUtility::TestStand - Cleanup Menus.gvi
  TestExec::Dependencies::Add User Menu Items.gvi
diagram:
  # This VI rebuilds the menu bar based on the
  # current page that is selected in the ListBar.
  case ($"error in (no error)") {
    frame No Error {
      call "Configure Engine Environment Menu item.gvi"(Menu Refnum In=$"Menu Refnum In", error in (no error)=$"error in (no error)") -> (Menu Refnum Out=w3, Commands out=w4, error out=w5)
      Build Array([128], w4) -> w6
      Tag Read(ref in="TestExec::Global Controls::Control Globals.grsc::ListBar") -> (Data=w7)
      Property Node(instance in=w7, error in=w5) -> ("CurrentPage"=w8, error out=w9)
      w10 = "TestExec::Global Controls::Control Globals.grsc::Execution View Manager"
      Tag Read(ref in=w10) -> (Data=w11)
      call "TestStand - Remove Commands from Menus.gvi"(Menu Refnum In=w3, error in (no error)=w9) -> (Menu Refnum Out=w12, error out=w13)
      w14 = "TestExec::Global Controls::Control Globals.grsc::Sequence File View Manager"
      Tag Read(ref in=w14) -> (Data=w15)
      case (w8) {
        frame 0, Default {
          call "TestStand - Insert Commands in Menu (SequenceFileView Manager).gvi"(Menu Refnum In=w12, Commands=[120], SequenceFileView Manager=w15, error in (no error)=w13, Top-Level Menu to Insert Into="FILE", TestStand UI Control Has Focus=$"TS UI Control Has Focus") -> (Menu Refnum Out=w18, error out=w19)
          call "TestStand - Insert Commands in Menu (SequenceFileView Manager).gvi"(Menu Refnum In=w18, Commands=w6, SequenceFileView Manager=w15, error in (no error)=w19, Top-Level Menu to Insert Into="EDIT", TestStand UI Control Has Focus=$"TS UI Control Has Focus") -> (Menu Refnum Out=w20, error out=w21)
          call "TestStand - Insert Commands in Menu (SequenceFileView Manager).gvi"(Menu Refnum In=w20, Commands=[121], SequenceFileView Manager=w15, error in (no error)=w21, Top-Level Menu to Insert Into="EXECUTE", TestStand UI Control Has Focus=$"TS UI Control Has Focus") -> (Menu Refnum Out=w22, error out=w23)
          call "TestStand - Insert Commands in Menu (SequenceFileView Manager).gvi"(Menu Refnum In=w22, Commands=[123], SequenceFileView Manager=w15, error in (no error)=w23, Top-Level Menu to Insert Into="DEBUG", TestStand UI Control Has Focus=$"TS UI Control Has Focus") -> (Menu Refnum Out=w24, error out=w25)
          call "TestStand - Insert Commands in Menu (SequenceFileView Manager).gvi"(Menu Refnum In=w24, Commands=[124], SequenceFileView Manager=w15, error in (no error)=w25, Top-Level Menu to Insert Into="CONFIGURE", TestStand UI Control Has Focus=$"TS UI Control Has Focus") -> (Menu Refnum Out=w26, error out=w27)
          call "TestStand - Insert Commands in Menu (SequenceFileView Manager).gvi"(Menu Refnum In=w26, Commands=[125], SequenceFileView Manager=w15, error in (no error)=w27, Top-Level Menu to Insert Into="TOOLS", TestStand UI Control Has Focus=$"TS UI Control Has Focus") -> (Menu Refnum Out=w28, error out=w29)
          call "TestStand - Insert Commands in Menu (SequenceFileView Manager).gvi"(Menu Refnum In=w28, Commands=[2, 440], SequenceFileView Manager=w15, error in (no error)=w29, Top-Level Menu to Insert Into="HELP", TestStand UI Control Has Focus=$"TS UI Control Has Focus") -> (Menu Refnum Out=w17, error out=w16)
        }
        frame 1 {
          call "TestStand - Insert Commands in Menu (ExecutionView Manager).gvi"(Menu Refnum In=w12, Commands=[120], ExecutionView Manager=w11, error in (no error)=w13, Top-Level Menu to Insert Into="FILE", TestStand UI Control Has Focus=$"TS UI Control Has Focus") -> (Menu Refnum Out=w30, error out=w31)
          call "TestStand - Insert Commands in Menu (ExecutionView Manager).gvi"(Menu Refnum In=w30, Commands=w6, ExecutionView Manager=w11, error in (no error)=w31, Top-Level Menu to Insert Into="EDIT", TestStand UI Control Has Focus=$"TS UI Control Has Focus") -> (Menu Refnum Out=w32, error out=w33)
          call "TestStand - Insert Commands in Menu (ExecutionView Manager).gvi"(Menu Refnum In=w32, Commands=[121], ExecutionView Manager=w11, error in (no error)=w33, Top-Level Menu to Insert Into="EXECUTE", TestStand UI Control Has Focus=$"TS UI Control Has Focus") -> (Menu Refnum Out=w34, error out=w35)
          call "TestStand - Insert Commands in Menu (ExecutionView Manager).gvi"(Menu Refnum In=w34, Commands=[123], ExecutionView Manager=w11, error in (no error)=w35, Top-Level Menu to Insert Into="DEBUG", TestStand UI Control Has Focus=$"TS UI Control Has Focus") -> (Menu Refnum Out=w36, error out=w37)
          call "TestStand - Insert Commands in Menu (ExecutionView Manager).gvi"(Menu Refnum In=w36, Commands=[124], ExecutionView Manager=w11, error in (no error)=w37, Top-Level Menu to Insert Into="CONFIGURE", TestStand UI Control Has Focus=$"TS UI Control Has Focus") -> (Menu Refnum Out=w38, error out=w39)
          call "TestStand - Insert Commands in Menu (ExecutionView Manager).gvi"(Menu Refnum In=w38, Commands=[125], ExecutionView Manager=w11, error in (no error)=w39, Top-Level Menu to Insert Into="TOOLS", TestStand UI Control Has Focus=$"TS UI Control Has Focus") -> (Menu Refnum Out=w40, error out=w41)
          call "TestStand - Insert Commands in Menu (ExecutionView Manager).gvi"(Menu Refnum In=w40, Commands=[2, 440], ExecutionView Manager=w11, error in (no error)=w41, Top-Level Menu to Insert Into="HELP", TestStand UI Control Has Focus=$"TS UI Control Has Focus") -> (Menu Refnum Out=w17, error out=w16)
        }
      }
      call "TestStand - Cleanup Menus.gvi"(Menu Refnum In=w17, error in (no error)=w16) -> (Menu Refnum Out=w42, error out=w43)
      call "Add User Menu Items.gvi"(Menu Refnum In=w42, error in (no error)=w43) -> (menu reference out=w1, error out=w2)
    }
    frame Error {
      w1 = $"Menu Refnum In"
      w2 = $"error in (no error)"
    }
  }
  $"Menu Refnum Out" <- w1
  $"error out" <- w2
