vi "Respond to Tab Control Value Change.gvi"   [LabVIEW NXG 2.0.0]
inputs:
  "New Tab Control Value": u32
  "error in (no error)": error
outputs:
  "error out": error
uses:
  TestExec::Dependencies::Set Tab Control Value for Execution.gvi
  Component::UI Controls::IStatusBar::IStatusBar.ShowPanes.gvi
diagram:
  # When the user changes the value of the tab control, store
  # the new value of the control in the current execution if the
  # user interface is currently showing executions. Also
  # change the set of StatusBar panes currently displayed.
  case ($"error in (no error)") {
    frame No Error {
      w2 = "TestExec\\Global Controls\\Control Globals.grsc\\Execution View Manager"
      Tag Read(ref in=w2) -> (Data=w3)
      w4 = "User,EngineEnvironment, FileModel,FileSelectedSteps,FileNumberOfSteps"  # File Panes
      w5 = "User,EngineEnvironment,ExecutionModel,ExecutionSelectedSteps,ExecutionNumberOfSteps,ProgressText,ProgressPercent"  # Execution Panes
      w6 = "User,EngineEnvironment,ExecutionModel,ReportLocation,ProgressText,ProgressPercent"  # Report Panes
      case ($"New Tab Control Value") {
        frame 0, Default {
          w7 = $"error in (no error)"
          w8 = w4
        }
        frame 1..2 {
          Property Node(instance in=w3, error in=$"error in (no error)") -> ("Execution"=w9, error out=w10)
          Is Not A Number Or Path Or Refnum(number=w9) -> w11
          case (w11) {
            frame False, Default {
              call "Set Tab Control Value for Execution.gvi"(Execution In=w9, Tab Control Value=$"New Tab Control Value", error in (no error)=w10) -> (Execution Out=w12, error out=w13)
              Close Reference(error in=w13, reference=w12) -> (error out=w7)
            }
            frame True {
              w7 = w10
            }
          }
          Is Equal(x=1, y=$"New Tab Control Value") -> w14
          Select(s=w14, t=w5, f=w6) -> w8
        }
      }
      Tag Read(ref in="TestExec\\Global Controls\\Control Globals.grsc\\StatusBar") -> (Data=w15)
      call "IStatusBar.ShowPanes.gvi"(reference in=w15, error in=w7, panesList=w8) -> (error out=w1)
    }
    frame Error {
      w1 = $"error in (no error)"
    }
  }
  $"error out" <- w1
