vi "RunLauncher.gvi"   [LabVIEW NXG 3.0.0]
inputs:
  "Path": path
uses:
  Component::Engine::IEngineInitializationSettings::IEngineInitializationSettings.CanInitializeEngine.gvi
  Component::Engine::IEngineInitializationSettings::IEngineInitializationSettings.SetEnvironmentPath.gvi
diagram:
  for (N = 200) {
    Wait(time to wait=50)
    w1 = "TestExec::Global Controls::Control Globals.grsc::Top Level VI Refnum"
    Tag Read(ref in=w1) -> (Data=w2)
    Property Node(instance in=w2) -> ("Execution State"=w3)
    Is Equal(x=w3, y="Idle") -> w4
    stop if w4
  }
  case (w4) {
    frame False, Default { }
    frame True {
      Automation Open(Automation Refnum Input=COM constant) -> (Automation Refnum Output=w5, error out=w6)
      s1 = w5  # shift register
      s2 = w6  # shift register
      for (N = 200) {
        call "IEngineInitializationSettings.CanInitializeEngine.gvi"(reference in=s1, error in=s2) -> (reference out=w7, error out=w8, return=w9)
        Path To String(path=$Path) -> (string=w10)
        call "IEngineInitializationSettings.SetEnvironmentPath.gvi"(reference in=w7, error in=w8, Path=w10) -> (error out=w11)
        next s2 = w11
        stop if w9
      }
      Close Reference(error in=s2, reference=s1) -> (error out=w12)
      case (w9) {
        frame False, Default { }
        frame True {
          Open VI Reference[CallOptions=AsynchronousCallWithoutWait](type specifier VI reference=StrictVIRefnum<"function Launcher.gvi"> constant, vi name="Launcher.gvi") -> (error out=w13, vi reference=w14)
          Call By Reference[CallByReferenceLoadType=0, CallByReferenceStyle=1](error in=w13, #ri=w14)
        }
      }
    }
  }
