vi "Set Tab Control Value for Execution.gvi"   [LabVIEW NXG 2.0.0]
inputs:
  "Execution In": COM
  "Tab Control Value": i32
  "error in (no error)": error
outputs:
  "Execution Out": COM
  "error out": error
uses:
  Component::Engine::Execution::Execution.AsPropertyObject.gvi
  Component::Engine::PropertyObject::PropertyObject.SetValNumber.gvi
diagram:
  $"Execution Out" <- $"Execution In"
  # Store the value of the tab control in a custom
  # property of the execution. This value can be
  # used later so that the user interface can
  # display the same tab that was displayed the last
  # time the execution was viewed.
  #
  # Note: This VI is marked to be reentrant since it is
  # shared by multiple event callback VIs.
  case ($"error in (no error)") {
    frame No Error {
      call "Execution.AsPropertyObject.gvi"(reference in=$"Execution In", error in=$"error in (no error)") -> (error out=w2, return=w3)
      call "PropertyObject.SetValNumber.gvi"(reference in=w3, error in=w2, lookupString="NIUI.LastActiveTab", options=0x1, newValue=$"Tab Control Value") -> (reference out=w4)
      Close Reference(reference=w4) -> (error out=w1)
    }
    frame Error {
      w1 = $"error in (no error)"
    }
  }
  $"error out" <- w1
