vi "Set Tab Value.gvi"   [LabVIEW NXG 2.0.0]
inputs:
  "TabCtl Refnum": "TabControl reference", required
  "Value": i32, required
  "error in (no error)": error
outputs:
  "error out": error
diagram:
  case ($"error in (no error)") {
    frame No Error {
      Is Not A Number Or Path Or Refnum(number=$"TabCtl Refnum") -> w2
      case (w2) {
        frame False, Default {
          Property Node(instance in=$"TabCtl Refnum", "ValueSignaling"=$Value, error in=$"error in (no error)") -> (error out=w1)
        }
        frame True {
          w3 = error {"status"=TRUE, "code"=1, "source"="Bad TabCtrl Refnum"}
          w1 = w3
        }
      }
    }
    frame Error {
      w1 = $"error in (no error)"
    }
  }
  $"error out" <- w1
