vi "Show Appropriate Tabs.gvi"   [LabVIEW NXG 2.0.0]
inputs:
  "ListBar Current Page": i32
  "error in (no error)": error
outputs:
  "error out": error
uses:
  TestExec::Dependencies::Set Tab Value.gvi
  TestExec::Dependencies::Get Tab Control Value for Execution.gvi
diagram:
  # Show the appropriate tabs on the Tab Control given the current page of the ListBar. If passed
  # -1 for the current page, show all tabs and select the SEQUENCE_FILE tab.
  #
  # Also, setting the value of the Tab Control causes the control to get the key focus. Therefore,
  # this VI resets the focus to the window that originally had the focus. This is necessary when
  # a TestStand User Interface Control originally had the focus.
  #
  # Note: This VI is marked to be reentrant since it is shared by multiple event callback VIs.
  case ($"error in (no error)") {
    frame No Error {
      w2 = "TestExec\\Global Controls\\Control Globals.grsc\\Execution View Manager"
      Tag Read(ref in=w2) -> (Data=w3)
      w4 = "TestExec\\Global Controls\\Control Globals.grsc\\TabCtl Refnum"
      Tag Read(ref in=w4) -> (Data=w5)
      Type Cast(type="TabControl reference" constant, x=w5) -> w6
      case ($"ListBar Current Page") {
        frame -1..0, Default {
          # Viewing sequence files or initializing.
          call "Set Tab Value.gvi"(TabCtl Refnum=w6, Value=0) -> (error out=w1)
        }
        frame 1 {
          Property Node(instance in=w3, error in=$"error in (no error)") -> ("Execution"=w7, error out=w8)
          Is Not A Number Or Path Or Refnum(number=w7) -> w9
          # Viewing executions.
          case (w9) {
            frame False, Default {
              call "Get Tab Control Value for Execution.gvi"(Execution In=w7, error in (no error)=w8) -> (Execution Out=w10, Tab Control Value=w11, error out=w12)
              Close Reference(error in=w12, reference=w10) -> (error out=w13)
              case (w11) {
                frame Default {
                  call "Set Tab Value.gvi"(TabCtl Refnum=w6, Value=w11, error in (no error)=w13) -> (error out=w1)
                }
                frame 0 {
                  w1 = w13
                }
              }
            }
            frame True {
              Property Node(instance in=w6, "ValueSignaling"=1, error in=w8) -> (error out=w1)
            }
          }
        }
      }
    }
    frame Error {
      w1 = $"error in (no error)"
    }
  }
  $"error out" <- w1
