vi "Shutdown.gvi"   [LabVIEW NXG 5.0.0]
inputs:
  "Full UI Data In": "FullUIData.gtype"
  "error in (no error)": error
outputs:
  "error out": error
types:
  "LabVIEW Events.gtype" = cluster{"Quit Application Event": "event Quit Application Event", "ReDraw Event": "event ReDraw", "Config Tab Event": "event Switch Tab Event"}
  "FullUIData.gtype" = cluster{"Front Panel Originally Open": bool, "TestStand Engine": COM, "COM Event Reg Refs": "CoreRuntime.EventCallbackRefnum"[], "LabVIEW Events": "LabVIEW Events.gtype", "Event Registration Refnum": "CoreRuntime.EventRegistrationRefnum", "Force Close Front Panel": bool}
uses:
  TSUtility::TestStand - Remove Commands from Menus.gvi
  TestExec::Dependencies::Close All Borders.gvi
diagram:
  Property Node(instance in=$"Full UI Data In") -> ("Force Close Front Panel"=w1, "Front Panel Originally Open"=w2, "TestStand Engine"=w3, "LabVIEW Events"=w4, "Event Registration Refnum"=w5, "COM Event Reg Refs"=w6)
  Not(x=w2) -> w7
  Logical Or(w1, w7) -> w8
  Property Node(instance in=w4) -> ("ReDraw Event"=w9, "Quit Application Event"=w10, "Config Tab Event"=w11)
  w12 = "TestExec::Global Controls::Control Globals.grsc::menu refnum"
  Tag Read(ref in=w12) -> (Data=w13)
  Type Cast(type="ApplicationMenu reference" constant, x=w13) -> w14
  call "TestStand - Remove Commands from Menus.gvi"(Menu Refnum In=w14, Remove User Menu Items=FALSE, error in (no error)=$"error in (no error)") -> (error out=w15)
  # 1.
  # Shut down VI:
  #
  # 1. Unregister for  ActiveX/COM Events.
  # 2. Unregister for LabVIEW Events.
  # 3. Destroy LabVIEW Events.
  # 4 Resize controls to edit time sizes.
  # 5. Close references and clear globals
  # 6. Close panel if it started closed. Also reset panel title for localization.
  # 7. Close reference to top-level VI. THIS MUST REMAIN THE VERY LAST STEP
  s1 = w15  # shift register
  for {
    w16 = each element of w6
    Unregister For Events(error in=s1, event registration refnum=w16) -> (error out=w17)
    next s1 = w17
  }
  # 2.
  Unregister For Events(error in=s1, event registration refnum=w5) -> (error out=w18)
  # 3.
  Destroy User Event(error in=w18, user event=w10) -> (error out=w19)
  # 4.
  Destroy User Event(error in=w19, user event=w9) -> (error out=w20)
  Destroy User Event(error in=w20, user event=w11) -> (error out=w21)
  # 5.
  call "Close All Borders.gvi"(error in (no error)=w21) -> (error out=w22)
  Close Reference(error in=w22, reference=w3) -> (error out=w23)
  # 6.
  # 7.
  case (w8) {
    frame False, Default {
      w25 = "TestExec::Global Controls::Control Globals.grsc::Top Level VI Refnum"
      Tag Read(ref in=w25) -> (Data=w26)
      Property Node(instance in=w26, error in=w23) -> ("Panel"=w27, error out=w28)
      Property Node(instance in=w27, error in=w28) -> ("Window"=w29, error out=w30)
      Close Window(reference in=w29, error in=w30) -> (error out=w24)
    }
    frame True {
      w24 = w23
    }
  }
  w31 = "TestExec::Global Controls::Control Globals.grsc::Top Level VI Refnum"
  Tag Read(ref in=w31) -> (Data=w32)
  Close Reference(error in=w24, reference=w32) -> (error out=w33)
  $"error out" <- w33
