vi "Update Title Bar Text.gvi"   [LabVIEW NXG 2.0.0]
inputs:
  "error in (no error)": error
outputs:
  "error out": error
uses:
  Component::UI Controls::IApplicationMgr::IApplicationMgr.GetEngine.gvi
  TSUtility::TestStand - Get Resource String.gvi
  Component::UI Controls::ISequenceFileViewMgr::ISequenceFileViewMgr.GetCaptionText.gvi
  Component::UI Controls::IExecutionViewMgr::IExecutionViewMgr.GetCaptionText.gvi
diagram:
  case ($"error in (no error)") {
    frame No Error {
      w2 = "TestExec\\Global Controls\\Control Globals.grsc\\Application Manager"
      Tag Read(ref in=w2) -> (Data=w3)
      call "IApplicationMgr.GetEngine.gvi"(reference in=w3, error in=$"error in (no error)") -> (error out=w4, return=w5)
      call "TestStand - Get Resource String.gvi"(Engine Reference In=w5, Category="TSUI_OI_MAIN_PANEL", Symbol="TESTSTAND_USER_INTERFACE", Error In=w4) -> (Engine Reference Out=w6, Resource String=w7, Error Out=w8)
      Close Reference(error in=w8, reference=w6) -> (error out=w9)
      Tag Read(ref in="TestExec\\Global Controls\\Control Globals.grsc\\ListBar") -> (Data=w10)
      Property Node(instance in=w10, error in=w9) -> ("CurrentPage"=w11, error out=w12)
      case (w11) {
        frame 0 {
          # sequence files are visible
          w15 = "TestExec\\Global Controls\\Control Globals.grsc\\Sequence File View Manager"
          Tag Read(ref in=w15) -> (Data=w16)
          call "ISequenceFileViewMgr.GetCaptionText.gvi"(reference in=w16, error in=w12, captionSource="CaptionSource_CurrentSequenceFile"(11), longName in=FALSE) -> (error out=w14, return=w13)
        }
        frame 1, Default {
          # Executions are visible
          w17 = "TestExec\\Global Controls\\Control Globals.grsc\\Execution View Manager"
          Tag Read(ref in=w17) -> (Data=w18)
          call "IExecutionViewMgr.GetCaptionText.gvi"(reference in=w18, error in=w12, captionSource="CaptionSource_CurrentExecution"(24), longName in=TRUE) -> (error out=w14, return=w13)
        }
      }
      w19 = "TestExec\\Global Controls\\Control Globals.grsc\\Top Level VI Refnum"
      Tag Read(ref in=w19) -> (Data=w20)
      Is Empty String Or Path(string/path=w13) -> w21
      case (w21) {
        frame False, Default {
          Concatenate Strings(w7, " - ", w13) -> w22
        }
        frame True {
          w22 = w7
        }
      }
      disable {
        frame Enabled {
          w1 = w14
        }
        frame Disabled {
          Property Node(instance in=w20, error in=w14) -> ("Panel"=w23, error out=w24)
          Property Node(instance in=w23, error in=w24) -> ("Window"=w25, error out=w26)
          Property Node(instance in=w25, "Title"=w22, error in=w26) -> (error out=w1)
        }
      }
    }
    frame Error {
      w1 = $"error in (no error)"
    }
  }
  $"error out" <- w1
