vi "Launcher.gvi"   [LabVIEW NXG 5.1.0]
# This VI is the splash screen and launcher for the full-featured user interface. It performs the following operations:
# 1. Opens reference to itself to pass to Full UI - Top-Level VI.vi. That VI will close the panel of this VI after it shows its own panel.
# 2. Opens and runs runs Full UI - Top-Level VI.vi. This is done dynamically to improve the launch time of the application.
# 3. Waits until Full UI - Top-Level VI.vi completes and closes the reference to that VI.
# 4. If the VI is not running in a built application, reopens its panel.
# 5. Closes the reference to itself.
# 6. If the VI is running in a built application, exits the application.
uses:
  TestExec::Top Level VIs::Top-Level VI.gvi
  TestExec::Top Level VIs::Launcher.gvi
diagram:
  # This VI is the splash screen and launcher for the full-featured
  # user interface. It performs the following operations:
  #
  # 1. set the TestStand environment based on the command line arguments
  # 2. Opens reference to itself to pass to Full UI - Top-Level VI.vi.
  # That VI will close the panel of this VI after it shows its own panel.
  # 3. Opens and runs Full UI - Top-Level VI.vi. This is done
  # dynamically to improve the launch time of the application.
  # 4. Waits until Full UI - Top-Level VI.vi completes and closes the
  # reference to that VI.
  # 5. If the VI is not running in a built application, reopens its panel.
  # 6. If the VI is running in a built application, exits the application.
  call "Top-Level VI.gvi"() -> (VIReference=w1)
  call "Launcher.gvi"() -> (VIReference=w2)
  Call By Reference[CallByReferenceLoadType=0, CallByReferenceStyle=0](L0=w2, #ri=w1) -> (R3=w3, error out=w4, #ro=w5)
  Merge Errors(w4, w3) -> (error out=w6)
  Close Reference(error in=w6, reference=w5) -> (error out=w7)
  disable (after w7) {
    frame RUN_TIME_ENGINE=="True", Default { }
    frame RUN_TIME_ENGINE=="False" { }
  }
