vi "Top-Level VI.gvi"   [LabVIEW NXG 5.0.0]
inputs:
  "Launcher VI Refnum": VIRefnum
outputs:
  "error out": error
panel controls:
  "Tab Control": i32
  "Application Manager": COM
  "SequenceFileView Manager": COM
  "ExecutionView Manager": COM
  "SequenceFile Label": COM
  "Execution Label": COM
  "List Bar": COM
  "Status Bar": COM
  "File Steps": COM
  "File Variables": COM
  "Sequences List": COM
  "Run Sequence Button": COM
  "Entry Point 2 Button": COM
  "Entry Point 1 Button": COM
  "Terminate/Restart Button": COM
  "Break/Resume Button": COM
  "Call Stack": COM
  "Threads": COM
  "Execution Variables": COM
  "Report View": COM
  "Insertion Palette": COM
  "Execution Steps": COM
types:
  "LabVIEW Events.gtype" = cluster{"Quit Application Event": "event Quit Application Event", "ReDraw Event": "event ReDraw", "Config Tab Event": "event Switch Tab Event"}
  "FullUIData.gtype" = cluster{"Front Panel Originally Open": bool, "TestStand Engine": COM, "COM Event Reg Refs": "CoreRuntime.EventCallbackRefnum"[], "LabVIEW Events": "LabVIEW Events.gtype", "Event Registration Refnum": "CoreRuntime.EventRegistrationRefnum", "Force Close Front Panel": bool}
  "MenuRefnum.gtype" = f64
  "TabCtlRefnum.gtype" = f64
  "Menu Queue Item Type.gtype" = cluster{"Command": string}
uses:
  TestExec::Top Level VIs::Top-Level VI.gvi
  TestExec::Dependencies::CheckControlReferences.gvi
  TestExec::Dependencies::Initialize.gvi
  TestExec::Dependencies::Show Appropriate Tabs.gvi
  TSUtility::TestStand - Does TestStand UI Control Have Focus.gvi
  TestExec::Dependencies::Rebuild Menu Bar.gvi
  TestExec::Dependencies::Add To Menu Queue.gvi
  TestExec::Dependencies::Respond to Tab Control Value Change.gvi
  TestExec::Dependencies::Shutdown.gvi
  TestExec::Dependencies::shutdown string constant.gvi
  TestExec::Dependencies::Display Error.gvi
  TSUtility::TestStand - Execute Menu Command.gvi
  TestExec::Dependencies::Process User Menus.gvi
diagram:
  Initialize UI Controls() -> (error out=w1)
  # This is the main VI in the full-featured user interface. Note that this VI runs in the User Interface execution system to optimize its performance and allow TestStand dialogs to
  # have correct modality behavior. Its subVIs are configured to run in the same execution system as their callers.
  #
  # Note:	This UI can function as an editor or an operator interface. The user can change the edit mode with a keystroke (ctrl+alt+shift+insert) or with a command line
  # argument. For more information and for instructions on how prevent the user from changing the edit mode, refer to the Creating Editor Applications topic in the TestStand help
  # 1. Initialize Globals for UI Control References, TestStand Manager Controls, Menu, and Tab
  # 2. Set Globals for Top Level VI and Control Borders. Check that control references are valid before trying to do any property node calls on them
  # 3. Wait in Main Event Loop until user clicks the Close box on the front panel window or the Quit Application Event is fired.
  # 4. handle user menu selections asynchronously so the UI is not blocked
  # 5. If the ShutDown method returns True, then the user interface can continue with shutting down. If not, continue handlngi events to wait for the Quit Application Event.
  # 6. Disable Panel Updates to speed drawing by preventing drawing intermediate states.
  #
  # To modify the installed user interfaces or to create new user interfaces, modify the files in the <TestStand Public>\UserInterfaces directory. You can use the read-only source files for the default user interfaces in the <TestStand>\UserInterfaces directory as a reference. National Instruments recommends that you track the changes you make to the user interface source code files so you can integrate the changes with any enhancements in future versions of the TestStand User Interfaces.
  case (w1) {
    frame No Error {
      w3 = "FullUIData.gtype" {all zero or empty}  # UI Data
      w4 = "Initialize Controls"  # Full UI States
      s1 = w1  # shift register
      s2 = w4  # shift register
      s3 = w3  # shift register
      while {  # Main Event Loop
        case (s2) {
          frame "Initialize Controls", Default {
            w9 = "TestExec::Global Controls::Control Globals.grsc::RunSequenceButton"
            # 1.
            Tag Write(Data=$"Run Sequence Button", ref in=w9)
            w10 = "TestExec::Global Controls::Control Globals.grsc::Terminate_Restart Button"
            Tag Write(Data=$"Terminate/Restart Button", ref in=w10)
            w11 = "TestExec::Global Controls::Control Globals.grsc::menu refnum"
            w12 = reference to unnamed native front panel  # Static Control Reference (Panel)
            Property Node(instance in=w12) -> ("ApplicationMenu"=w13)  # FrontPanelCanvas properties
            w14 = "MenuRefnum.gtype" 0  # Control GlobalsMenu Refnum
            Type Cast(type=w14, x=w13) -> w15
            Tag Write(Data=w15, ref in=w11)
            w16 = "TestExec::Global Controls::Control Globals.grsc::Break_Resume Button"
            Tag Write(Data=$"Break/Resume Button", ref in=w16)
            w17 = "TestExec::Global Controls::Control Globals.grsc::File Variables"
            Tag Write(Data=$"File Variables", ref in=w17)
            w18 = "TestExec::Global Controls::Control Globals.grsc::Execution Steps"
            Tag Write(Data=$"Execution Steps", ref in=w18)
            Tag Write(Data=$"File Steps", ref in="TestExec::Global Controls::Control Globals.grsc::FileSteps")
            w19 = "TestExec::Global Controls::Control Globals.grsc::TabCtl Refnum"
            w20 = reference to "Tab Control"  # Static Control Reference (Tab Control)
            w21 = "TabCtlRefnum.gtype" 0  # Control GlobalsTabCtl Refnum
            Type Cast(type=w21, x=w20) -> w22
            Tag Write(Data=w22, ref in=w19)
            Tag Write(Data=$"Call Stack", ref in="TestExec::Global Controls::Control Globals.grsc::CallStack")
            w23 = "TestExec::Global Controls::Control Globals.grsc::SequencesList"
            Tag Write(Data=$"Sequences List", ref in=w23)
            Tag Write(Data=$Threads, ref in="TestExec::Global Controls::Control Globals.grsc::Threads")
            w24 = "TestExec::Global Controls::Control Globals.grsc::Entry Point 2 Button"
            Tag Write(Data=$"Entry Point 2 Button", ref in=w24)
            w25 = "TestExec::Global Controls::Control Globals.grsc::Execution Variables"
            Tag Write(Data=$"Execution Variables", ref in=w25)
            call "Top-Level VI.gvi"() -> (VIReference=w26)
            w27 = "TestExec::Global Controls::Control Globals.grsc::Top Level VI Refnum"
            Tag Write(Data=w26, ref in=w27)
            w28 = "TestExec::Global Controls::Control Globals.grsc::Entry Point 1 Button"
            Tag Write(Data=$"Entry Point 1 Button", ref in=w28)
            Tag Write(Data=$"List Bar", ref in="TestExec::Global Controls::Control Globals.grsc::ListBar")
            w29 = "TestExec::Global Controls::Control Globals.grsc::InsertionPalette"
            Tag Write(Data=$"Insertion Palette", ref in=w29)
            Tag Write(Data=$"Status Bar", ref in="TestExec::Global Controls::Control Globals.grsc::StatusBar")
            w30 = "TestExec::Global Controls::Control Globals.grsc::ReportView"
            Tag Write(Data=$"Report View", ref in=w30)
            w31 = "TestExec::Global Controls::Control Globals.grsc::Launcher VI Refnum"
            Tag Write(Data=$"Launcher VI Refnum", ref in=w31)
            w32 = "TestExec::Global Controls::Control Globals.grsc::SequenceFile Label"
            Tag Write(Data=$"SequenceFile Label", ref in=w32)
            w33 = "TestExec::Global Controls::Control Globals.grsc::Application Manager"
            Tag Write(Data=$"Application Manager", ref in=w33)
            w34 = "TestExec::Global Controls::Control Globals.grsc::Execution Label"
            Tag Write(Data=$"Execution Label", ref in=w34)
            w35 = "TestExec::Global Controls::Control Globals.grsc::Sequence File View Manager"
            Tag Write(Data=$"SequenceFileView Manager", ref in=w35)
            # Note: LabVIEW Global Variables are safe to use here because they are only written to at the start of the application and clearing them when finalizing shutdown.
            # Note: You can right click a global and select Find » Global References to view all of the locations where a variable is accessed.
            w36 = "TestExec::Global Controls::Control Globals.grsc::Execution View Manager"
            Tag Write(Data=$"ExecutionView Manager", ref in=w36)
            w37 = "Initialize"  # Full UI States
            w5 = default
            w6 = s1
            w7 = w37
            w8 = s3
          }
          frame "Initialize" {
            # 2.
            call "CheckControlReferences.gvi"(error in (no error)=s1) -> (error out=w38)
            call "Initialize.gvi"(error in (no error)=w38) -> (FF UI Data Out=w8, error out=w6)
            w39 = "Handle Events"  # Full UI States
            w40 = "Shutdown"  # Full UI States
            # if an error occurs while initilaizing, shut down immediately
            Select(s=w6, t=w40, f=w39) -> w7
            w5 = default
          }
          frame "Handle Events" {
            Property Node(instance in=s3) -> ("Event Registration Refnum"=w41)
            # 3.
            event (dynamic events = w41) {
              on dynamic event 0 {
                # The callback VI for the ExitApplication event has run and fired the Quit Application Event. The user interface can now stop.
                w42 = "Shutdown"  # Full UI States
                w6 = s1
                w7 = w42
                w8 = s3
              }
              on dynamic event 1 {
                # Handle Resizing of controls or the UI window.  This event is generated within the event callbacks for resizeable controls.  Resizing is not yet supported in the LabVIEW NXG UI Example.
                # 6.
                w43 = "Handle Events"  # Full UI States
                w6 = s1
                w7 = w43
                w8 = s3
              }
              on dynamic event 2 {
                # Note: Any programmatic updates to native NXG controls, such as the tab control, should be implemented in the main UI and not in a registered event.  Programmatic updates to controls within registered activeX events can cause lv NXG to hang.
                Event Data() -> ("Active Tab"=w44)
                call "Show Appropriate Tabs.gvi"(ListBar Current Page=w44)
                w45 = "Handle Events"  # Full UI States
                w6 = default
                w7 = w45
                w8 = s3
              }
              on "Application menu" Menu activation? {
                Event Data() -> ("Control Reference"=w46)
                w47 = "TestExec::Global Controls::Control Globals.grsc::Application Manager"
                Tag Read(ref in=w47) -> (Data=w48)
                Property Node(instance in=w48, error in=s1) -> ("IsShuttingDown"=w49, error out=w50)
                # User has opened menu or selected a shortcut key that might be a menu item. Rebuild the menu bar.
                case (w49) {
                  frame False, Default {
                    call "TestStand - Does TestStand UI Control Have Focus.gvi"(error in (no error)=w50) -> (TestStand UI Control Has Focus=w52, error out=w53)
                    w54 = "TestExec::Global Controls::Control Globals.grsc::TestStand UI Control Has Focus"
                    Tag Write(Data=w52, ref in=w54)
                    call "Rebuild Menu Bar.gvi"(Menu Refnum In=w46, TS UI Control Has Focus=w52, error in (no error)=w53) -> (error out=w6)
                    w51 = FALSE
                  }
                  frame True {
                    # Don't respond to event if currently shutting down.
                    w6 = w50
                    w51 = TRUE
                  }
                }
                Event Filter("Discard?"=w51)
                w55 = "Handle Events"  # Full UI States
                w7 = w55
                w8 = s3
              }
              on "Application menu" Menu selection (User) {
                Event Data() -> ("ItemTag"=w56)
                # User has selected a menu item.
                w57 = "TestExec::Global Controls::Control Globals.grsc::Application Manager"
                Tag Read(ref in=w57) -> (Data=w58)
                Property Node(instance in=w58, error in=s1) -> ("IsShuttingDown"=w59, error out=w60)
                # To add User Menu Items, modify the Top-Level Menu.grtm file, and add code to handle the menu events in "Process User Menus.vi"
                case (w59) {
                  frame False, Default {
                    call "Add To Menu Queue.gvi"(Menu Command=w56, error in=w60) -> (error out=w6)
                  }
                  frame True {
                    # Don't respond to event
                    # if currently shutting
                    # down.
                    w6 = w60
                  }
                }
                w61 = "Handle Events"  # Full UI States
                w7 = w61
                w8 = s3
              }
              on "Tab Control" Value changed {
                Event Data() -> ("New Value"=w62)
                # The Tab Control value has changed.
                # Update other controls.
                call "Respond to Tab Control Value Change.gvi"(New Tab Control Value=w62, error in (no error)=s1) -> (error out=w6)
                w63 = "Handle Events"  # Full UI States
                w7 = w63
                w8 = s3
              }
              on "Window" Close? {
                Property Node(instance in=s3, "Force Close Front Panel"=TRUE) -> (instance out=w8)
                Event Filter("Discard?"=TRUE)
                w64 = "TestExec::Global Controls::Control Globals.grsc::Application Manager"
                Tag Read(error in=s1, ref in=w64) -> (Data=w65)
                Active X Method Call[MethodCallTarget="@"](reference in=w65) -> (error out=w6, return=w66)
                w67 = "Handle Events"  # Full UI States
                w68 = "Shutdown"  # Full UI States
                Select(s=w66, t=w68, f=w67) -> w7
              }
            }
            w5 = default
          }
          frame "Shutdown" {
            call "Shutdown.gvi"(Full UI Data In=s3, error in (no error)=s1) -> (error out=w69)
            call "shutdown string constant.gvi"() -> (shutdown command=w70)
            call "Add To Menu Queue.gvi"(Menu Command=w70, error in=w69) -> (error out=w6)
            w71 = "Shutdown"  # Full UI States
            w5 = TRUE
            w7 = w71
            w8 = s3
          }
        }
        call "Display Error.gvi"(error in (no error)=w6) -> (cleared error out=w72)
        next s1 = w72
        next s2 = w7
        next s3 = w8
        stop if w5
      }
      Obtain Queue(element data type="Menu Queue Item Type.gtype" {all zero or empty}, error in=w1, name="TSUIMenuQueue") -> (error out=w73, queue out=w74)
      s4 = w73  # shift register
      s5 = w74  # shift register
      while {  # Menu Handler Loop
        # 4.
        Dequeue Element(error in=s4, queue=s5) -> (element=w75, error out=w76, queue out=w77)
        Property Node(instance in=w75) -> ("Command"=w78)
        call "shutdown string constant.gvi"() -> (shutdown command=w79)
        Is Equal(x=w78, y=w79) -> w80
        case (w80) {
          frame False, Default {
            call "TestStand - Execute Menu Command.gvi"(Menu Tag In=w78, error in (no error)=w76) -> (Menu Tag Out=w83, User Menu Selected=w84, error out=w85)
            call "Process User Menus.gvi"(Menu Tag=w83, User Menu Selected=w84, error in (no error)=w85) -> (error out=w82)
            w81 = FALSE
          }
          frame True {
            # main event loop has ended, stop the menu handler
            w81 = TRUE
            w82 = w76
          }
        }
        call "Display Error.gvi"(error in (no error)=w82) -> (cleared error out=w86)
        next s4 = w86
        next s5 = w77
        stop if w81
      }
      Release Queue(error in=s4, force destroy=TRUE, queue=s5) -> (error out=w87)
      Merge Errors(s1, w87) -> (error out=w2)
    }
    frame Error {
      # Error occurred in the launcher. Report the error and shut down immediately
      call "Display Error.gvi"(error in (no error)=w1) -> (cleared error out=w2)
    }
  }
  $"error out" <- w2
