vi "Callback - DisplayExecution.gvi"   [LabVIEW NXG 4.0.0]
inputs:
  "Event Common Data": T1
  "Control Ref": COM
  "Event Data": cluster{"exec": COM, "reason": i32}
  "User Parameter": "UI Data.gtype"
types:
  T1 = cluster{"Event Source": i32, "Event Type": u32, "Time Stamp": u32, "Index": u32}
  T2 = cluster{"ApplicationMgr": COM, "ExecutionViewMgr": COM, "SequenceFileViewMgr": COM}
  T3 = cluster{"Open Sequence File": COM, "Close Sequence File": COM, "EntryPoint 1": COM, "EntryPoint 2": COM, "Run Sequence": COM, "Close Execution": COM, "Break/Resume": COM, "Terminate/Restart": COM, "Terminate All": COM, "Login/Logout": COM, "Exit": COM, "Sequence Files List": COM, "Sequences List": COM, "Executions List": COM, "SequenceView": COM, "ReportView": COM}
  T4 = cluster{"LabVIEW - Event Registration Ref": "CoreRuntime.EventRegistrationRefnum", "LabVIEW - Quit Application Event": "event Quit Application Event", "Top Level VI reference": VIRefnum, "ActiveX event callback ref": "CoreRuntime.EventCallbackRefnum", "TestStand Engine": COM}
  "UI Data.gtype" = cluster{"Manager Controls": T2, "Visible Controls": T3, "Other References": T4}
diagram:
  Property Node(instance in=$"User Parameter") -> ("Other References:Top Level VI reference"=w1, "Manager Controls:ExecutionViewMgr"=w2)
  Property Node(instance in=$"Event Data") -> ("exec"=w3, "reason"=w4)
  # The Application Manager generates the DisplayExecution
  # event when TestStand starts a new execution that is not
  # initially hidden. It also generates the event when the
  # execution breaks.
  #
  # Note: This VI is marked to be reentrant since it is an
  # ActiveX event callback VI.
  case (w4) {
    frame Default { }
    frame 2, 4 {
      # If the DisplayExecution event
      # was generated because the
      # execution hit a breakpoint (2) or
      # because the execution is breaking
      # on a run-time error (4), bring the
      # operator interface application to
      # the front by setting the
      # Front Panel.Open property of the
      # top-level VI to True.
    }
  }
  Property Node(instance in=w2, "Execution"=w3)
