vi "Callback - DisplaySequenceFile.gvi"   [LabVIEW NXG 4.0.0]
inputs:
  "Event Common Data": T1
  "Control Ref": COM
  "Event Data": cluster{"file": COM, "reason": i32}
  "User Parameter": "UI Data.gtype"
types:
  T1 = cluster{"Event Source": i32, "Event Type": u32, "Time Stamp": u32, "Index": u32}
  T2 = cluster{"ApplicationMgr": COM, "ExecutionViewMgr": COM, "SequenceFileViewMgr": COM}
  T3 = cluster{"Open Sequence File": COM, "Close Sequence File": COM, "EntryPoint 1": COM, "EntryPoint 2": COM, "Run Sequence": COM, "Close Execution": COM, "Break/Resume": COM, "Terminate/Restart": COM, "Terminate All": COM, "Login/Logout": COM, "Exit": COM, "Sequence Files List": COM, "Sequences List": COM, "Executions List": COM, "SequenceView": COM, "ReportView": COM}
  T4 = cluster{"LabVIEW - Event Registration Ref": "CoreRuntime.EventRegistrationRefnum", "LabVIEW - Quit Application Event": "event Quit Application Event", "Top Level VI reference": VIRefnum, "ActiveX event callback ref": "CoreRuntime.EventCallbackRefnum", "TestStand Engine": COM}
  "UI Data.gtype" = cluster{"Manager Controls": T2, "Visible Controls": T3, "Other References": T4}
diagram:
  Property Node(instance in=$"Event Data") -> ("file"=w1)
  Property Node(instance in=$"User Parameter") -> ("Manager Controls:SequenceFileViewMgr"=w2)
  # Set the current sequence file to be the newly
  # opened sequence file.
  Property Node(instance in=w2, "SequenceFile"=w1)
