vi "Callback - ExitApplication.gvi"   [LabVIEW NXG 4.0.0]
inputs:
  "Event common data": T1
  "Control ref": COM
  "User parameter": "UI Data.gtype"
types:
  T1 = cluster{"Event Source": i32, "Event Type": u32, "Time Stamp": u32, "Index": u32}
  T2 = cluster{"ApplicationMgr": COM, "ExecutionViewMgr": COM, "SequenceFileViewMgr": COM}
  T3 = cluster{"Open Sequence File": COM, "Close Sequence File": COM, "EntryPoint 1": COM, "EntryPoint 2": COM, "Run Sequence": COM, "Close Execution": COM, "Break/Resume": COM, "Terminate/Restart": COM, "Terminate All": COM, "Login/Logout": COM, "Exit": COM, "Sequence Files List": COM, "Sequences List": COM, "Executions List": COM, "SequenceView": COM, "ReportView": COM}
  T4 = cluster{"LabVIEW - Event Registration Ref": "CoreRuntime.EventRegistrationRefnum", "LabVIEW - Quit Application Event": "event Quit Application Event", "Top Level VI reference": VIRefnum, "ActiveX event callback ref": "CoreRuntime.EventCallbackRefnum", "TestStand Engine": COM}
  "UI Data.gtype" = cluster{"Manager Controls": T2, "Visible Controls": T3, "Other References": T4}
diagram:
  Property Node(instance in=$"User parameter") -> ("Other References:LabVIEW - Quit Application Event"=w1)
  Generate User Event(event data=0, user event=w1)
