vi "Callback - Report Error.gvi"   [LabVIEW NXG 4.0.0]
inputs:
  "Event Common Data": T1
  "Control Ref": COM
  "Event Data": T2
  "User Parameter": "UI Data.gtype"
types:
  T1 = cluster{"Event Source": i32, "Event Type": u32, "Time Stamp": u32, "Index": u32}
  T2 = cluster{"errorCode": i32, "errorMessage": string}
  T3 = cluster{"ApplicationMgr": COM, "ExecutionViewMgr": COM, "SequenceFileViewMgr": COM}
  T4 = cluster{"Open Sequence File": COM, "Close Sequence File": COM, "EntryPoint 1": COM, "EntryPoint 2": COM, "Run Sequence": COM, "Close Execution": COM, "Break/Resume": COM, "Terminate/Restart": COM, "Terminate All": COM, "Login/Logout": COM, "Exit": COM, "Sequence Files List": COM, "Sequences List": COM, "Executions List": COM, "SequenceView": COM, "ReportView": COM}
  T5 = cluster{"LabVIEW - Event Registration Ref": "CoreRuntime.EventRegistrationRefnum", "LabVIEW - Quit Application Event": "event Quit Application Event", "Top Level VI reference": VIRefnum, "ActiveX event callback ref": "CoreRuntime.EventCallbackRefnum", "TestStand Engine": COM}
  "UI Data.gtype" = cluster{"Manager Controls": T3, "Visible Controls": T4, "Other References": T5}
uses:
  Component::UI Controls::IApplicationMgr::IApplicationMgr.GetEngine.gvi
  TestExec::TestStand - Append Code and Description to Error Source.gvi
  TSUtility::TestStand - Get Resource String.gvi
  Component::Engine::IEngine::IEngine.DisplayMessageBox.gvi
diagram:
  Property Node(instance in=$"Event Data") -> ("errorCode"=w1, "errorMessage"=w2)
  Property Node(instance in=no error, "code"=w1, "source"=w2) -> (instance out=w3)
  Property Node(instance in=$"User Parameter") -> ("Manager Controls:ApplicationMgr"=w4)
  call "IApplicationMgr.GetEngine.gvi"(reference in=w4) -> (return=w5)
  # The Application Manager generates the ReportError event
  # when TestStand generates an error.
  #
  # Note: This VI is marked to be reentrant since it is an ActiveX
  # event callback VI.
  call "TestStand - Append Code and Description to Error Source.gvi"(Engine=w5, error in (no error)=w3) -> (error out=w6)
  # Display error information.
  Property Node(instance in=w6) -> ("source"=w7)
  call "TestStand - Get Resource String.gvi"(Engine Reference In=w5, Category="TSUI_OI_MAIN_PANEL", Symbol="ERR_BOX_TITLE", Error In=w6) -> (Engine Reference Out=w8, Resource String=w9, Error Out=w10)
  call "IEngine.DisplayMessageBox.gvi"(reference in=w8, error in=w10, dlgTitle=w9, messageText=w7, msgBoxType="MsgBox_Error"(2)) -> (reference out=w11, error out=w12)
  Close Reference(error in=w12, reference=w11)
