vi "Configure Application Manager.gvi"   [LabVIEW NXG 4.0.0]
inputs:
  "UI Data": "UI Data.gtype"
  "error in": error
outputs:
  "UI Data Out": "UI Data.gtype"
  "error out": error
types:
  T1 = cluster{"ApplicationMgr": COM, "ExecutionViewMgr": COM, "SequenceFileViewMgr": COM}
  T2 = cluster{"Open Sequence File": COM, "Close Sequence File": COM, "EntryPoint 1": COM, "EntryPoint 2": COM, "Run Sequence": COM, "Close Execution": COM, "Break/Resume": COM, "Terminate/Restart": COM, "Terminate All": COM, "Login/Logout": COM, "Exit": COM, "Sequence Files List": COM, "Sequences List": COM, "Executions List": COM, "SequenceView": COM, "ReportView": COM}
  T3 = cluster{"LabVIEW - Event Registration Ref": "CoreRuntime.EventRegistrationRefnum", "LabVIEW - Quit Application Event": "event Quit Application Event", "Top Level VI reference": VIRefnum, "ActiveX event callback ref": "CoreRuntime.EventCallbackRefnum", "TestStand Engine": COM}
  "UI Data.gtype" = cluster{"Manager Controls": T1, "Visible Controls": T2, "Other References": T3}
uses:
  Component::UI Controls::IApplicationMgr::IApplicationMgr.ConnectCommand.gvi
diagram:
  Property Node(instance in=$"UI Data") -> ("Manager Controls:ApplicationMgr"=w1, "Visible Controls:Login/Logout"=w2, "Visible Controls:Exit"=w3, "Visible Controls:Terminate All"=w4, instance out=w5)
  $"UI Data Out" <- w5
  call "IApplicationMgr.ConnectCommand.gvi"(reference in=w1, error in=$"error in", uiObj=w2, cmdKind="CommandKind_LoginLogout"(27)) -> (reference out=w6, error out=w7)
  call "IApplicationMgr.ConnectCommand.gvi"(reference in=w6, error in=w7, uiObj=w3, cmdKind="CommandKind_Exit"(30)) -> (reference out=w8, error out=w9)
  call "IApplicationMgr.ConnectCommand.gvi"(reference in=w8, error in=w9, uiObj=w4, cmdKind="CommandKind_TerminateAll"(77)) -> (reference out=w10, error out=w11)
  Property Node(instance in=w10, "ReloadSequenceFilesOnStart"="ReloadFile_All"(2), error in=w11) -> (error out=w12)
  $"error out" <- w12
