vi "Configure ExecutionView Manager.gvi"   [LabVIEW NXG 4.0.0]
inputs:
  "UI Data": "UI Data.gtype"
  "error in": error
outputs:
  "UI Data Out": "UI Data.gtype"
  "error out": error
types:
  T1 = cluster{"ApplicationMgr": COM, "ExecutionViewMgr": COM, "SequenceFileViewMgr": COM}
  T2 = cluster{"Open Sequence File": COM, "Close Sequence File": COM, "EntryPoint 1": COM, "EntryPoint 2": COM, "Run Sequence": COM, "Close Execution": COM, "Break/Resume": COM, "Terminate/Restart": COM, "Terminate All": COM, "Login/Logout": COM, "Exit": COM, "Sequence Files List": COM, "Sequences List": COM, "Executions List": COM, "SequenceView": COM, "ReportView": COM}
  T3 = cluster{"LabVIEW - Event Registration Ref": "CoreRuntime.EventRegistrationRefnum", "LabVIEW - Quit Application Event": "event Quit Application Event", "Top Level VI reference": VIRefnum, "ActiveX event callback ref": "CoreRuntime.EventCallbackRefnum", "TestStand Engine": COM}
  "UI Data.gtype" = cluster{"Manager Controls": T1, "Visible Controls": T2, "Other References": T3}
uses:
  Component::UI Controls::IExecutionViewMgr::IExecutionViewMgr.ConnectCommand.gvi
  Component::UI Controls::IExecutionViewMgr::IExecutionViewMgr.ConnectExecutionList.gvi
  Component::UI Controls::IExecutionViewMgr::IExecutionViewMgr.ConnectExecutionView.gvi
  Component::UI Controls::IExecutionViewMgr::IExecutionViewMgr.ConnectReportView.gvi
diagram:
  Property Node(instance in=$"UI Data") -> ("Manager Controls:ExecutionViewMgr"=w1, "Visible Controls:Close Execution"=w2, "Visible Controls:Break/Resume"=w3, "Visible Controls:Terminate/Restart"=w4, "Visible Controls:Executions List"=w5, "Visible Controls:SequenceView"=w6, "Visible Controls:ReportView"=w7, instance out=w8)
  Property Node(instance in=w1, "StepGroupMode"="StepGroupMode_AllGroups"(2), error in=$"error in") -> (error out=w9, instance out=w10)
  call "IExecutionViewMgr.ConnectCommand.gvi"(reference in=w10, error in=w9, uiObj=w2, cmdKind="CommandKind_Close"(21)) -> (reference out=w11, error out=w12)
  call "IExecutionViewMgr.ConnectCommand.gvi"(reference in=w11, error in=w12, uiObj=w3, cmdKind="CommandKind_BreakResume"(72)) -> (reference out=w13, error out=w14)
  call "IExecutionViewMgr.ConnectCommand.gvi"(reference in=w13, error in=w14, uiObj=w4, cmdKind="CommandKind_TerminateRestart"(74)) -> (reference out=w15, error out=w16)
  call "IExecutionViewMgr.ConnectExecutionList.gvi"(reference in=w15, error in=w16, uiObj=w5) -> (reference out=w17, error out=w18, return=w19)
  w20 = """"%CurrentExecution% - " + ("%UUTSerialNumber%" == "" ? "" : (ResStr("TSUI_OI_MAIN_PANEL","SERIAL_NUMBER")
+ " %UUTSerialNumber% - ")) + ("%TestSocketIndex%" == "" ? "" : (ResStr("TSUI_OI_MAIN_PANEL","SOCKET_NUMBER")
+ " %TestSocketIndex% - ")) + "%ModelState%""""
  Property Node(instance in=w19, "DisplayExpression"=w20, error in=w18) -> (error out=w21, instance out=w22)
  Close Reference(error in=w21, reference=w22) -> (error out=w23)
  call "IExecutionViewMgr.ConnectExecutionView.gvi"(reference in=w17, error in=w23, uiObj=w6) -> (reference out=w24, error out=w25)
  call "IExecutionViewMgr.ConnectReportView.gvi"(reference in=w24, error in=w25, uiObj=w7) -> (error out=w26)
  $"error out" <- w26
  $"UI Data Out" <- w8
