vi "Configure SeqFileView Manager.gvi"   [LabVIEW NXG 4.0.0]
inputs:
  "UI Data": "UI Data.gtype"
  "error in": error
outputs:
  "UI Data Out": "UI Data.gtype"
  "error out": error
types:
  T1 = cluster{"ApplicationMgr": COM, "ExecutionViewMgr": COM, "SequenceFileViewMgr": COM}
  T2 = cluster{"Open Sequence File": COM, "Close Sequence File": COM, "EntryPoint 1": COM, "EntryPoint 2": COM, "Run Sequence": COM, "Close Execution": COM, "Break/Resume": COM, "Terminate/Restart": COM, "Terminate All": COM, "Login/Logout": COM, "Exit": COM, "Sequence Files List": COM, "Sequences List": COM, "Executions List": COM, "SequenceView": COM, "ReportView": COM}
  T3 = cluster{"LabVIEW - Event Registration Ref": "CoreRuntime.EventRegistrationRefnum", "LabVIEW - Quit Application Event": "event Quit Application Event", "Top Level VI reference": VIRefnum, "ActiveX event callback ref": "CoreRuntime.EventCallbackRefnum", "TestStand Engine": COM}
  "UI Data.gtype" = cluster{"Manager Controls": T1, "Visible Controls": T2, "Other References": T3}
uses:
  Component::UI Controls::ISequenceFileViewMgr::ISequenceFileViewMgr.ConnectCommand.gvi
  Component::UI Controls::ISequenceFileViewMgr::ISequenceFileViewMgr.ConnectSequenceFileList.gvi
  Component::UI Controls::ISequenceFileViewMgr::ISequenceFileViewMgr.ConnectSequenceList.gvi
diagram:
  Property Node(instance in=$"UI Data") -> ("Manager Controls:SequenceFileViewMgr"=w1, "Visible Controls:EntryPoint 1"=w2, "Visible Controls:EntryPoint 2"=w3, "Visible Controls:Open Sequence File"=w4, "Visible Controls:Close Sequence File"=w5, "Visible Controls:Run Sequence"=w6, "Visible Controls:Sequence Files List"=w7, "Visible Controls:Sequences List"=w8, instance out=w9)
  $"UI Data Out" <- w9
  Property Node(instance in=w1, "StepGroupMode"="StepGroupMode_AllGroups"(2), error in=$"error in") -> (error out=w10, instance out=w11)
  call "ISequenceFileViewMgr.ConnectCommand.gvi"(reference in=w11, error in=w10, uiObj=w2, cmdKind="CommandKind_ExecutionEntryPoints_Set"(141), Index=0) -> (reference out=w12, error out=w13)
  call "ISequenceFileViewMgr.ConnectCommand.gvi"(reference in=w12, error in=w13, uiObj=w3, cmdKind="CommandKind_ExecutionEntryPoints_Set"(141), Index=1) -> (reference out=w14, error out=w15)
  call "ISequenceFileViewMgr.ConnectCommand.gvi"(reference in=w14, error in=w15, uiObj=w4, cmdKind="CommandKind_OpenSequenceFile"(20)) -> (reference out=w16, error out=w17)
  call "ISequenceFileViewMgr.ConnectCommand.gvi"(reference in=w16, error in=w17, uiObj=w5, cmdKind="CommandKind_Close"(21)) -> (reference out=w18, error out=w19)
  call "ISequenceFileViewMgr.ConnectCommand.gvi"(reference in=w18, error in=w19, uiObj=w6, cmdKind="CommandKind_RunCurrentSequence"(44)) -> (reference out=w20, error out=w21)
  call "ISequenceFileViewMgr.ConnectSequenceFileList.gvi"(reference in=w20, error in=w21, uiObj=w7, fullPath in=TRUE) -> (reference out=w22, error out=w23)
  call "ISequenceFileViewMgr.ConnectSequenceList.gvi"(reference in=w22, error in=w23, uiObj=w8) -> (error out=w24)
  $"error out" <- w24
