vi "Simple UI.gvi"   [LabVIEW NXG 5.1.0]
panel controls:
  "Open Sequence File": COM
  "Close Sequence File": COM
  "EntryPoint 1": COM
  "EntryPoint 2": COM
  "Run Sequence": COM
  "Close Execution": COM
  "Break_Resume": COM
  "Terminate_Restart": COM
  "Terminate All": COM
  "Login_Logout": COM
  "Exit": COM
  "Sequence Files": COM
  "Sequences": COM
  "Executions": COM
  "SequenceView": COM
  "Report View": COM
  "Application Manager": COM
  "ExecutionView Manager": COM
  "SequenceFileView Manager": COM
  "UI Data": "UI Data.gtype"
types:
  T1 = cluster{"ApplicationMgr": COM, "ExecutionViewMgr": COM, "SequenceFileViewMgr": COM}
  T2 = cluster{"Open Sequence File": COM, "Close Sequence File": COM, "EntryPoint 1": COM, "EntryPoint 2": COM, "Run Sequence": COM, "Close Execution": COM, "Break/Resume": COM, "Terminate/Restart": COM, "Terminate All": COM, "Login/Logout": COM, "Exit": COM, "Sequence Files List": COM, "Sequences List": COM, "Executions List": COM, "SequenceView": COM, "ReportView": COM}
  T3 = cluster{"LabVIEW - Event Registration Ref": "CoreRuntime.EventRegistrationRefnum", "LabVIEW - Quit Application Event": "event Quit Application Event", "Top Level VI reference": VIRefnum, "ActiveX event callback ref": "CoreRuntime.EventCallbackRefnum", "TestStand Engine": COM}
  "UI Data.gtype" = cluster{"Manager Controls": T1, "Visible Controls": T2, "Other References": T3}
uses:
  TestExec::TS Display Error.gvi
  NI::G Core::Error::Clear Error Cluster.gvi
  TestExec::Simple UI.gvi
  Component::UI Controls::IApplicationMgr::IApplicationMgr.GetEngine.gvi
  TestExec::Configure Application Manager.gvi
  TestExec::Configure ExecutionView Manager.gvi
  TestExec::Configure SeqFileView Manager.gvi
  TestExec::Callback - DisplaySequenceFile.gvi
  TestExec::Callback - ExitApplication.gvi
  TestExec::Callback - DisplayExecution.gvi
  TestExec::Callback - Wait.gvi
  TestExec::Callback - Report Error.gvi
  Component::UI Controls::IApplicationMgr::IApplicationMgr.Start.gvi
  Component::UI Controls::IApplicationMgr::IApplicationMgr.Shutdown.gvi
diagram:
  w1 = "Initialize"  # States
  Initialize UI Controls() -> (error out=w2)
  # This is the main VI in the simple TestStand user interface. Review the Creating Custom User Interfaces topic in the TestStand Reference Help and the examine the source code for the Full UI example for more information about event handling, resizing controls, using menus, and enabling editing.
  s1 = w1  # shift register
  s2 = $"UI Data"  # shift register
  s3 = w2  # shift register
  while {
    case (s3) {
      frame Error {
        Property Node(instance in=s2) -> ("Manager Controls:ApplicationMgr"=w7, instance out=w4)
        call "TS Display Error.gvi"(Application Manager=w7, Error In=s3) -> (Error Out=w8)
        # Handle Errors. If the Application Manager has started when the error occurred, continue handling events to ensure proper shutdown.  Otherwise, shut down immediately.
        Property Node(instance in=w7, error in=w8) -> ("IsStarted"=w9, error out=w10)
        w11 = "Handle Events"  # States
        w12 = "Shutdown"  # States
        Select(s=w9, t=w11, f=w12) -> w3
        call "Clear Error Cluster.gvi"(error in=w10) -> (error out=w6)
        w5 = default
      }
      frame No Error {
        case (s1) {
          frame "Initialize", Default {
            w13 = "Configure Connections"  # States
            call "Simple UI.gvi"() -> (VIReference=w14)
            Type Cast(type=COM constant, x=$"Application Manager") -> w15
            call "IApplicationMgr.GetEngine.gvi"(reference in=w15, error in=s3) -> (error out=w6, return=w16)
            # To add new TestStand controls to the UI:
            # 1. Add a new TestStand Control on the front panel from the TestStand Palette
            # 2. Modify the TestStand UI Data Type definition to include a reference to this control
            # 3. Expand the Bundle by Name structure and wire the TestStand control terminal to the new element terminal
            # 4. Connect the new control to a manager control in the subVIs within the configure connections state.
            # Store references to the UI controls for later use. Also, set the TestStand main application window to be this VI
            Property Node(instance in=s2, "Other References:TestStand Engine"=w16, "Manager Controls:ApplicationMgr"=$"Application Manager", "Manager Controls:ExecutionViewMgr"=$"ExecutionView Manager", "Manager Controls:SequenceFileViewMgr"=$"SequenceFileView Manager", "Visible Controls:Open Sequence File"=$"Open Sequence File", "Visible Controls:Close Sequence File"=$"Close Sequence File", "Visible Controls:EntryPoint 1"=$"EntryPoint 1", "Visible Controls:EntryPoint 2"=$"EntryPoint 2", "Visible Controls:Run Sequence"=$"Run Sequence", "Visible Controls:Close Execution"=$"Close Execution", "Visible Controls:Break/Resume"=$Break_Resume, "Visible Controls:Terminate/Restart"=$Terminate_Restart, "Visible Controls:Terminate All"=$"Terminate All", "Visible Controls:Login/Logout"=$Login_Logout, "Visible Controls:Exit"=$Exit, "Visible Controls:Sequence Files List"=$"Sequence Files", "Visible Controls:Sequences List"=$Sequences, "Visible Controls:Executions List"=$Executions, "Visible Controls:SequenceView"=$SequenceView, "Visible Controls:ReportView"=$"Report View", "Other References:Top Level VI reference"=w14) -> (instance out=w4)
            w3 = w13
            w5 = default
          }
          frame "Configure Connections" {
            # Any new TestStand controls you create must be connected to a manager control in order to function.  Follow the steps in the Initialize state to add a reference to your controls to the UI Data cluster.  You can then call a connection method in one of the VIs in this case.
            #
            # Choose the manager control and connection method based on the desired functionality of the control. Refer to the Connecting Manager Controls to Visible Controls Topic in the TestStand help for details on the Manager controls and available connection methods.
            w17 = "Register Event Callbacks"  # States
            # Configure the Connections and Commands for the Application, SequenceFileView, and ExecutionView Managers.
            call "Configure Application Manager.gvi"(UI Data=s2, error in=s3) -> (UI Data Out=w18, error out=w19)
            call "Configure ExecutionView Manager.gvi"(UI Data=w18, error in=w19) -> (UI Data Out=w20, error out=w21)
            call "Configure SeqFileView Manager.gvi"(UI Data=w20, error in=w21) -> (UI Data Out=w4, error out=w6)
            w3 = w17
            w5 = default
          }
          frame "Register Event Callbacks" {
            Create User Event[EventName="Quit Application Event"](user event data type=i32 0) -> (user event out=w22)
            Register For Events("Quit Application Event"=w22) -> (error out=w23, event registration refnum out=w24)
            Property Node(instance in=s2, "Other References:LabVIEW - Event Registration Ref"=w24, "Other References:LabVIEW - Quit Application Event"=w22) -> ("Manager Controls:ApplicationMgr"=w25, instance out=w26)
            # To add new callbacks to handle additional TestStand events:
            # 1. Expand the Register Event Callback node.
            # 2. Wire a reference to a manager control which defines the desired event (usually the ApplicationManager) to the Event terminal
            # 3. Click the event terminal to select the event to handle.
            # 4. Wire the UI Data cluster to the User Parameter terminal.  This allows the callback VI to access the data.
            # 5. Right Click the "VI Ref" Terminal and select Create Callback VI.  The generated GVI will execute when the event occurs.
            # 6. Modify the callback VI to implement the desired functionality
            #
            # Refer to the TestStand Help Topic "Customizing the LabVIEW NXG Simple User Interface" for more information on creating event callbacks.
            call "Callback - DisplaySequenceFile.gvi"() -> (VIReference=w27)
            call "Callback - ExitApplication.gvi"() -> (VIReference=w28)
            call "Callback - DisplayExecution.gvi"() -> (VIReference=w29)
            call "Callback - Wait.gvi"() -> (VIReference=w30)
            call "Callback - Report Error.gvi"() -> (VIReference=w31)
            # Register callback VIs to handle events from the Application Manager. Also register the Quit Application User Event.
            Register Event Callback(w25, w27, w26, w25, w28, w26, w25, w29, w26, w25, w30, w26, w25, w31, w26, error in=w23) -> (event callback ref out=w32)
            Property Node(instance in=w26, "Other References:ActiveX event callback ref"=w32) -> (instance out=w4)
            w33 = "Start Application"  # States
            w3 = w33
            w5 = default
            w6 = s3
          }
          frame "Start Application" {
            w34 = "Handle Events"  # States
            # Start TestStand.
            Property Node(instance in=s2) -> ("Manager Controls:ApplicationMgr"=w35, instance out=w4)
            call "IApplicationMgr.Start.gvi"(reference in=w35, error in=s3) -> (error out=w6)
            w3 = w34
            w5 = default
          }
          frame "Handle Events" {
            Property Node(instance in=s2) -> ("Other References:LabVIEW - Event Registration Ref"=w36, instance out=w4)
            # If you add LabVIEW controls to the UI, use the event structure to handle user interaction.
            # 5. Wait in Main Event Loop until user clicks the Close box on the front panel window or the Quit Application Event is fired.
            event (dynamic events = w36) {
              on dynamic event 0 {
                w37 = "Shutdown"  # States
                w3 = w37
              }
              on "Window" Close? {
                Event Filter("Discard?"=TRUE)
                Property Node(instance in=s2) -> ("Manager Controls:ApplicationMgr"=w38)
                call "IApplicationMgr.Shutdown.gvi"(reference in=w38) -> (return=w39)
                w40 = "Shutdown"  # States
                w41 = "Handle Events"  # States
                Select(s=w39, t=w40, f=w41) -> w3
              }
            }
            w5 = default
            w6 = s3
          }
          frame "Shutdown" {
            w42 = "Shutdown"  # States
            # Clean up events and references
            Property Node(instance in=s2) -> ("Other References:TestStand Engine"=w43, "Other References:LabVIEW - Quit Application Event"=w44, "Other References:LabVIEW - Event Registration Ref"=w45, "Other References:ActiveX event callback ref"=w46, "Other References:Top Level VI reference"=w47, instance out=w4)
            Unregister For Events(error in=s3, event registration refnum=w46) -> (error out=w48)
            Unregister For Events(error in=w48, event registration refnum=w45) -> (error out=w49)
            Destroy User Event(error in=w49, user event=w44) -> (error out=w50)
            Close Reference(error in=w50, reference=w43) -> (error out=w51)
            Property Node(instance in=w47, error in=w51) -> ("Panel"=w52, error out=w53)
            Property Node(instance in=w52, error in=w53) -> ("Window"=w54, error out=w55)
            Close Window(reference in=w54, error in=w55) -> (error out=w6)
            w3 = w42
            w5 = TRUE
          }
        }
      }
    }
    next s1 = w3
    next s2 = w4
    next s3 = w6
    stop if w5
  }
