vi "TS Display Error.gvi"   [LabVIEW NXG 2.0.0]
inputs:
  "Application Manager": COM
  "Error In": error
outputs:
  "Error Out": error
uses:
  Component::UI Controls::IApplicationMgr::IApplicationMgr.GetEngine.gvi
  NI::G Core::Error::Read Error Code.gvi
  Component::Engine::IEngine::IEngine.GetErrorString.gvi
  NI::G Core::Error::Read Description.gvi
  NI::G Core::Error::Read Location.gvi
  NI::G Core::Error::Clear Error Cluster.gvi
  TSUtility::TestStand - Get Resource String.gvi
  Component::Engine::IEngine::IEngine.DisplayMessageBox.gvi
diagram:
  # This VI displays an error dialog in the event of an error.
  case ($"Error In") {
    frame No Error, Default {
      w1 = $"Error In"
    }
    frame Error {
      call "IApplicationMgr.GetEngine.gvi"(reference in=$"Application Manager") -> (error out=w2, return=w3)
      call "Read Error Code.gvi"(error in=$"Error In") -> (code=w4)
      call "IEngine.GetErrorString.gvi"(reference in=w3, error in=w2, errorCode=w4) -> (reference out=w5, error out=w6, errorString=w7, return=w8)
      # TestStand error. Simply display
      # the error message. Use a
      # localized string for the error dialog
      # title.
      case (w8) {
        frame False, Default {
          call "Read Description.gvi"(error in=$"Error In") -> (description=w10)
          # Not a TestStand error. Try Updating using LV
          # error DB.  Note that this error msg will not be localized
          # unless customer is using a localized version of LabVIEW.
          case (w10) {
            frame Default {
              w9 = w10
            }
            frame "" {
              call "Read Location.gvi"(error in=$"Error In") -> (location=w9)
            }
          }
        }
        frame True {
          # TestStand error. Use the error Source and  TestStand Error
          # string information to generate the error message
          call "Read Location.gvi"(error in=$"Error In") -> (location=w11)
          Concatenate Strings(w7, "\n", "\n", w11) -> w9
        }
      }
      call "Clear Error Cluster.gvi"(error in=w6) -> (error out=w12)
      Is Not A Number Or Path Or Refnum(number=w5) -> w13
      case (w13) {
        frame False, Default {
          call "TestStand - Get Resource String.gvi"(Engine Reference In=w5, Category="TSUI_OI_MAIN_PANEL", Symbol="ERR_BOX_TITLE", Error In=w12, Default String="Error") -> (Engine Reference Out=w14, Resource String=w15, Error Out=w16)
          call "IEngine.DisplayMessageBox.gvi"(reference in=w14, error in=w16, dlgTitle=w15, messageText=w9, msgBoxType="MsgBox_Error"(2)) -> (reference out=w17, error out=w18)
          Close Reference(error in=w18, reference=w17) -> (error out=w1)
        }
        frame True {
          # Invalid engine ref, display
          # message with LabVIEW dialog
          One Button Dialog(message=w9)
          w1 = w12
        }
      }
    }
  }
  $"Error Out" <- w1
