vi "TestStand - Append Code and Description to Error Source.gvi"   [LabVIEW NXG 2.0.0]
# This VI Updates the error source by appending the error code and code description if the code is a TestStand error code.
inputs:
  "Engine": COM
  "error in (no error)": error
outputs:
  "error out": error
uses:
  NI::G Core::Error::Read Error Code.gvi
  Component::Engine::IEngine::IEngine.GetErrorString.gvi
  TSUtility::TestStand - Get Resource String.gvi
  NI::G Core::Error::Read Location.gvi
diagram:
  # This VI Updates the error source by appending the error code and code description if the code is a TestStand error code.
  case ($"error in (no error)") {
    frame No Error {
      # Error not present no need to process source message
      w1 = $"error in (no error)"
    }
    frame Error {
      Is Not A Number Or Path Or Refnum(number=$Engine) -> w2
      case (w2) {
        frame False, Default {
          call "Read Error Code.gvi"(error in=$"error in (no error)") -> (code=w3)
          call "IEngine.GetErrorString.gvi"(reference in=$Engine, error in=$"error in (no error)", errorCode=w3) -> (error out=w4, errorString=w5)
          call "TestStand - Get Resource String.gvi"(Engine Reference In=$Engine, Category="TSUI_APPLICATION_MGR", Symbol="ERROR_CODE", Error In=w4) -> (Engine Reference Out=w6, Error Out=w7, Found=w8, Resource String=w9)
          Close Reference(error in=w7, reference=w6)
          call "Read Location.gvi"(error in=$"error in (no error)") -> (location=w10)
          case (w8) {
            frame False, Default {
              w11 = w10
            }
            frame True {
              case (w5) {
                frame Default {
                  w11 = default
                }
                frame "" {
                  Match Pattern(regular expression=w10, string=w5) -> (offset past match=w12)
                  case (w12) {
                    frame 0, Default {
                      w11 = ""
                    }
                    frame ..-1 {
                      # if the codeDescription
                      # is not in the message add it
                      w11 = w10
                    }
                  }
                }
              }
            }
          }
          Number To Decimal String(number=w3) -> (decimal integer string=w13)
          Match Pattern(regular expression=w13, string=w10) -> (offset past match=w14)
          case (w14) {
            frame Default {
              # Code Already
              # Present
              w15 = default
            }
            frame -1 {
              # Add Error Code If not present
              Search And Replace String(input string=w9, replace all (F)=TRUE, replace string ("")=w13, search string="%1") -> (result string=w15)
            }
          }
          Concatenate Strings(w11, w15) -> w16
          case (w16) {
            frame Default {
              call "Read Location.gvi"(error in=$"error in (no error)") -> (location=w17)
              # if added text isn't empty
              # append to source
              Concatenate Strings(w17, "\n\n", w16) -> w18
              Property Node(instance in=$"error in (no error)", "source"=w18) -> (instance out=w1)
            }
            frame "" {
              w1 = $"error in (no error)"
            }
          }
        }
        frame True {
          # Didn't get engine do nothing!
          w1 = $"error in (no error)"
        }
      }
    }
  }
  $"error out" <- w1
